# Grasshopper definition arabia_a.gh (Grasshopper 1.0.4)
# plug-ins: GH_CPython

座面飾り波形深さ = Slider(1, range=1..3, expression="x*10")
座面飾り高さ = Slider(1, range=1..3, expression="x*100")
手すり位置 = Slider(1, range=1..2, expression="x*0.5")
手すり高さ = Slider(1, range=1..3, expression="x*50")
基本奥行 = Slider(2, range=2..3, expression="x*200")
座面高さ = Slider(4, range=4..5, expression="x*100")
基本幅 = Slider(4, range=4..8, expression="x*100")
波数 = Slider(3, range=3..7)
rectangle = Rectangle(Plane=PlaneXY(0, 0, 0), XSize=基本幅, YSize=基本奥行, Radius=0)  # -> Rectangle, Length
pi = Pi(Factor=波数)
dom = ConstructDomain(DomainStart=0, DomainEnd=pi)
debrep = DeconstructBrep(Brep=rectangle.Rectangle)  # -> Faces, Edges, Vertices
subtraction = Subtraction(A=座面高さ, B=座面飾り高さ)
rec = Rectangle({Plane=PlaneXY(-10, -10, 0), Size=Domain2(u=0..20, v=0..20)})
pt = Point(debrep.Vertices)
range = Range(Domain=dom, Steps="30")
Z = UnitZ(Factor=座面高さ)
orient = Orient(Geometry=rec, Source=PlaneXY(0, 0, 0), Target=pt)  # -> Geometry, Transform
Z_2 = UnitZ(Factor=座面高さ)
t = Expression(A=座面飾り波形深さ, t=range, Expression="A*sin(t)")
divide = DivideCurve(Curve=debrep.Edges, Count="30", Kinks=False)  # -> Points, Tangents, Parameters
move = Move(Geometry=debrep.Edges, Motion=Z)  # -> graft(Geometry), Transform
pdecon = Deconstruct(Point=divide.Points)  # -> XComponent, YComponent, ZComponent
extr = Extrude(Base=orient.Geometry, Direction=Z_2)
item = ListItem(List=debrep.Faces, Index=0, Wrap=True)
Z_3 = UnitZ(Factor=座面高さ)
pt_2 = ConstructPoint(XCoordinate=pdecon.XComponent, YCoordinate=pdecon.YComponent, ZCoordinate=t)
move_2 = Move(Geometry=item, Motion=Z_3)  # -> Geometry, Transform
Z_4 = UnitZ(Factor="30")
graft = GraftTree(Tree=move.Geometry, IncludeEmptyLists=True, IncludeNullItems=True)
Z_5 = UnitZ(Factor=subtraction)
intcrv = Interpolate(Vertices=pt_2, Degree=3, Periodic=False, KnotStyle=1)  # -> Curve, Length, Domain
extr_2 = Extrude(Base=move_2.Geometry, Direction=Z_4)
debrep_2 = DeconstructBrep(Brep=move_2.Geometry)  # -> Faces, Edges, Vertices
move_3 = Move(Geometry=intcrv.Curve, Motion=Z_5)  # -> Geometry, Transform
cap = CapHoles(Brep=extr)
item_2 = ListItem(List=debrep_2.Edges, Index=0, Wrap=True)  # -> Item, Item1, Item2, Item3
item_3 = ListItem(List=debrep_2.Vertices, Index=0, Wrap=True)  # -> Item, Item1, Item2, Item3
rulesrf = RuledSurface(CurveA=graft, CurveB=move_3.Geometry)
pt_3 = Point(item_3.Item2)
pt_4 = Point(item_3.Item3)
sunion = SolidUnion(Breps=rulesrf)
ln = Line(StartPoint=pt_3, EndPoint=pt_4)
offset = Offset(Surface=sunion, Distance="-10", Retrim=True)
mid = TK_MidPoint(C=ln)  # -> P
# ---------- mid: Python ----------
import rhinoscriptsyntax as rs

if C!=None:
    P=rs.CurveMidPoint(C)
else:
    P=None
# ---------- end mid ----------
loft = Loft(
    Curves=[rulesrf, offset],
    Options={Adjust=False, Closed=False, LoftEnds=0, LoftSimp=0, LoftType=0, Rebuild=10, Refit=0.01})
line = Line(item_2.Item1)
line_2 = Line(item_2.Item3)
join = BrepJoin(Breps=[rulesrf, offset, loft])  # -> flatten(Breps), Closed
end = EndPoints(Curve=line)  # -> Start, End
subtraction_2 = Subtraction(A=1, B=手すり位置)
eval = EvaluateCurve(Curve=line_2, Parameter=手すり位置)  # -> Point, Tangent, Angle
pt_5 = Point(end.End)
eval_2 = EvaluateCurve(Curve=line, Parameter=subtraction_2)  # -> Point, Tangent, Angle
pt_6 = Point(eval_2.Point)
orient_2 = Orient(Geometry=rec, Source=PlaneXY(0, 0, 0), Target=[pt_3, mid, pt_4])  # -> Geometry, Transform
Z_6 = UnitZ(Factor=座面高さ)
trim = TrimSolid(Shape=join.Breps, Cutters=cap)
Z_7 = UnitZ(Factor=1)
ln_2 = Line(StartPoint=pt_5, EndPoint=pt_6)
line_3 = LineSDL(Start=[eval_2.Point, eval.Point], Direction=Z_7, Length=手すり高さ)
len = Length(Curve=ln_2)
extr_3 = Extrude(Base=orient_2.Geometry, Direction=Z_6)
end_2 = EndPoints(Curve=line_3)  # -> Start, End
cap_2 = CapHoles(Brep=extr_3)
Y = UnitY(Factor=1)
pt_7 = Point(end_2.End)
item_4 = ListItem(List=cap_2, Index=0, Wrap=True)  # -> Item, Item1, Item2
line_4 = LineSDL(Start=pt_7, Direction=Y, Length=len)
brep = Brep(item_4.Item)
brep_2 = Brep(item_4.Item2)
pipe = Pipe(Curve=[line_4, line_3], Radius="10", Caps=2)
debrep_3 = DeconstructBrep(Brep=brep)  # -> Faces, Edges, Vertices
debrep_4 = DeconstructBrep(Brep=brep_2)  # -> Faces, Edges, Vertices
item_5 = ListItem(List=debrep_3.Vertices, Index="2", Wrap=True)
item_6 = ListItem(List=debrep_4.Vertices, Index="1", Wrap=True)
ln_3 = Line(StartPoint=item_5, EndPoint=item_6)
xz = XZPlane(Origin=item_6)
len_2 = Length(Curve=ln_3)
rectangle_2 = Rectangle(Plane=xz, XSize=len_2, YSize="-150", Radius=0)  # -> Rectangle, Length
Y_2 = UnitY(Factor=expr("x*-1", "10"))
boundary = BoundarySurfaces(Edges=rectangle_2.Rectangle)
extr_4 = Extrude(Base=boundary, Direction=Y_2)
debrep_5 = DeconstructBrep(Brep=extr_4)  # -> Faces, Edges, Vertices
item_7 = ListItem(List=debrep_5.Faces, Index="5", Wrap=True)
faceb = FaceBoundaries(Mesh=item_7)
offset_2 = Offset(Curve=faceb, Distance="-15", Plane=PlaneXY(0, 0, 0), Corners=1)
Y_3 = UnitY(Factor=expr("x*-1", "10"))
boundary_2 = BoundarySurfaces(Edges=offset_2)
extr_5 = Extrude(Base=boundary_2, Direction=Y_3)

brep_3 = Brep(<brep referenced from the Rhino model>)  # disabled
bbox = BoundingBox(Content=brep_3, Plane=PlaneXY(0, 0, 0))  # -> Box, Box_2; disabled
debrep_6 = DeconstructBrep(Brep=bbox.Box)  # -> Faces, Edges, Vertices; disabled
panel = Panel(debrep_6.Vertices)  # disabled

brep_4 = Brep(pipe)
brep_5 = Brep(extr_2)
brep_6 = Brep(extr_4)
brep_7 = Brep(extr_5)
brep_8 = Brep(trim)
brep_9 = Brep(cap)
brep_10 = Brep(cap_2)
merge = Merge(Data1=brep_8, Data2=brep_9, Data3=brep_4, Data4=brep_5, Data5=brep_6, Data6=brep_7, Data7=brep_10)
join_2 = BrepJoin(Breps=merge)  # -> Breps, Closed
brep_11 = Brep(join_2.Breps)

panel_2 = Panel("""基本幅
基本奥行
座面高さ
座面飾り高さ
座面飾り波形深さ
波数
手すり位置
手すり高さ""")
panel_3 = Panel("動かしたいスライダー名を指定して、Saveボタンをおすと上で指定したディレクトリにmatファイルが連番で保存されます。")
c_script = CSharpScript(sliderNames=panel_2, save=Button())  # -> out; inputs sliderNames: list of String, save: Boolean
# ---------- c_script: C# ----------
    _sliderNames = sliderNames;



    if (!save)
      return;

    if (_running)
      return;


    _run = true;


    GrasshopperDocument.SolutionEnd += OnSolutionEnd;
# ---------- c_script: C# additional code ----------
  private bool _run = false;
  private bool _running = false;
  private List<string> _sliderNames;

  private void OnSolutionEnd(object sender, GH_SolutionEventArgs e)
  {
    // Unregister the event, we don't want to get called again.
    e.Document.SolutionEnd -= OnSolutionEnd;

    // If we're not supposed to run, abort now.
    if (!_run)
      return;

    // If we're already running, abort now.
    if (_running)
      return;
    
    // Reset run and running states.
    _run = false;
    _running = true;

    try
    {
      // Find all sliders.
      List<Grasshopper.Kernel.Special.GH_NumberSlider> sliders = new List<Grasshopper.Kernel.Special.GH_NumberSlider>();

      foreach (IGH_DocumentObject docObject in GrasshopperDocument.Objects)
      {
        Grasshopper.Kernel.Special.GH_NumberSlider slider = docObject as Grasshopper.Kernel.Special.GH_NumberSlider;
        if (slider == null)
          continue;
        sliders.Add(slider);
      }
      if (sliders.Count == 0)
      {
        System.Windows.Forms.MessageBox.Show("No sliders could be found", "<harsh buzzing sound>", MessageBoxButtons.OK);
        return;
      }


      List<bool> contains = new List<bool>();
      List<Grasshopper.Kernel.Special.GH_NumberSlider> filteredSliders = new List<Grasshopper.Kernel.Special.GH_NumberSlider>();
      foreach(Grasshopper.Kernel.Special.GH_NumberSlider slider in sliders){
        if(_sliderNames.Contains(slider.NickName)){
          filteredSliders.Add(slider);
        }

      }
      //A = filteredSliders.Count;

      // Set all sliders back to zero.
      //GH_Document.EnableSolutions = false;
      foreach (Grasshopper.Kernel.Special.GH_NumberSlider slider in filteredSliders)
        slider.TickValue = 0;

      while (true)
      {
        int idx = 0;
        if (!MoveToNextPermutation(ref idx, filteredSliders))
          break;

        // We've just got a new valid permutation. Solve the new solution.
        e.Document.NewSolution(false);
        Rhino.RhinoDoc.ActiveDoc.Views.Redraw();

      }

    }
    catch(Exception ex)
    {
      // Ehm, exception, best swallow it here lest it totally crashes everything.
    }
    finally
    {
      // Always make sure that _running is switched off.
      _running = false;
    }


    
  }

  private bool MoveToNextPermutation(ref int index, List<Grasshopper.Kernel.Special.GH_NumberSlider> filteredSliders)
  {
    if (index >= filteredSliders.Count)
      return false;

    Grasshopper.Kernel.Special.GH_NumberSlider slider = filteredSliders[index];
    if (slider.TickValue < slider.TickCount)
    {
      // Increment the slider.
      slider.TickValue++;
      return true;
    }
    else
    {
      // The current slider is already at the maximum value. Reset it back to zero.
      slider.TickValue = 0;

      // Move on to the next slider.
      index++;

      // If we've run out of sliders to modify, we're done permutatin'
      if (index >= filteredSliders.Count)
        return false;

      return MoveToNextPermutation(ref index, filteredSliders);
    }
  }
# ---------- end c_script ----------

panel_4 = Panel("""基本奥行き
肘掛け高さ""")
panel_5 = Panel("C:/Users/RFA4/Desktop/G_Chair_mat/train_sample/arabia_a")

# ----
# Path: Matファイルを保存するディレクトリ
# Size:バウンディングボックスの横・縦・高さの大きさ
# Resolution：分割数（ShapeNetsの分割数が30なので、30がいいと思います）
# Save: TrueでMatが保存されます。
# File: ファイルの名前です
# Reset: 連番のリセット
# "F:/odrive/Google Drive/JH/Projects/[096] Deep Learning Chair/02. projects/saved_data"
geo = Geometry(flatten(brep_11))
number_slider = Slider(1200, range=0..1500)
number_slider_2 = Slider(30, range=0..100)
cluster = Cluster(
    geometry=geo,
    path=panel_5,
    size=number_slider,
    resolution=number_slider_2,
    save=Toggle(True),
    file="chair_arabia_a",
    reset=Button())

int = Integer(Slider(16, range=0..100))

range_2 = Range(Domain=number_slider, Steps=expr("x-1", simplify(number_slider_2)))
pt_8 = ConstructPoint(XCoordinate=range_2, YCoordinate=0, ZCoordinate=0)
gh_cpython = GH_CPython(path=panel_5, file="chair_arabia_a", num=int, load=Button())  # -> output, a; inputs path: list, file: list, num: list, load: list
#   port path: [required] - [type = int] - [default = None] Descripe your input here * bullet point. * bullet point
#   port output: indicate your output description here. refers to a new line.
# ---------- gh_cpython: Python ----------
import scipy.io
import Grasshopper as gh

numformat =  str('{:010d}'.format(num))
mat = scipy.io.loadmat(path + "/" + file + "-" + numformat)

#output_ = numformat



output_ = mat["instance"].tolist()

a = mat["instance"]
# ---------- end gh_cpython ----------
graft_2 = GraftTree(Tree=pt_8, IncludeEmptyLists=True, IncludeNullItems=True)
Y_4 = UnitY(Factor=range_2)
panel_6 = Panel("保存したMatを確認するためのデフィニションです。")
move_4 = Move(Geometry=graft_2, Motion=Y_4)  # -> Geometry, Transform
c_script_2 = CSharpScript(x=gh_cpython.output, n=number_slider_2)  # -> out, A; inputs x: list of Int32, n: Int32
# ---------- c_script_2: C# ----------
    DataTree<int> tree = new DataTree<int>();

    int count = 0;
    for(int i = 0; i < n; i++){
      for(int s = 0; s < n; s++){
        for(int t = 0; t < n; t++){
          GH_Path path = new GH_Path(i, s,t);
          tree.Add(x[count], path);

          count++;
        }
      }
    }

    A = tree;
# ---------- end c_script_2 ----------
graft_3 = GraftTree(Tree=move_4.Geometry, IncludeEmptyLists=True, IncludeNullItems=True)
Z_8 = UnitZ(Factor=range_2)
item_8 = ListItem(List=range_2, Index=1, Wrap=True)
move_5 = Move(Geometry=graft_3, Motion=Z_8)  # -> simplify(Geometry), Transform
division = Division(A=item_8, B=2)
graft_4 = GraftTree(Tree=move_5.Geometry, IncludeEmptyLists=True, IncludeNullItems=True)  # -> simplify(Tree)
cull = CullPattern(List=graft_4, CullPattern=c_script_2.A)
box = CenterBox(Base=cull, X=division, Y=division, Z=division)

preview = CustomPreview(Geometry=box, Material=ColourSwatch(SwatchColor=RGB(102, 168, 255)))

# ==== cluster Cluster
resolution = ClusterInput()
size = ClusterInput()
geometry = ClusterInput()
int = Integer(resolution)

num = Number(size)
geo = Geometry(flatten(geometry))
range = Range(Domain=num, Steps=expr("x-1", simplify(int)))
bbox = BoundingBox(Content=geo, Plane=PlaneXY(0, 0, 0), UnionBox=True)  # -> Box, Box_2
area = Area(Geometry=bbox.Box)  # -> Area, Centroid
pt = ConstructPoint(XCoordinate=range, YCoordinate=0, ZCoordinate=0)  # -> simplify(graft(Point))
pt_2 = ConstructPoint(XCoordinate=num, YCoordinate=num, ZCoordinate=0)
pt_3 = ConstructPoint(XCoordinate=num, YCoordinate=num, ZCoordinate=num)
pt_4 = ConstructPoint(XCoordinate=0, YCoordinate=0, ZCoordinate=0)
pdecon = Deconstruct(Point=area.Centroid)  # -> XComponent, YComponent, ZComponent
division = Division(A=pt_2, B=2)
box = Box2Pt(PointA=pt_4, PointB=pt_3, Plane=PlaneXY(0, 0, 0))
Z = UnitZ(Factor=range)
pt_5 = ConstructPoint(XCoordinate=pdecon.XComponent, YCoordinate=pdecon.YComponent, ZCoordinate=0)
item = ListItem(List=range, Index=1, Wrap=True)
orient = Orient(Geometry=geo, Source=pt_5, Target=division)  # -> Geometry, Transform
division_2 = Division(A=item, B=2.01)
mesh = Mesh(orient.Geometry)
mjoin = MeshJoin(Meshes=mesh)

Y = UnitY(Factor=range)
move = Move(Geometry=pt, Motion=Y)  # -> graft(Geometry), Transform

move_2 = Move(Geometry=move.Geometry, Motion=Z)  # -> Geometry, Transform
flatten = FlattenTree(Tree=move_2.Geometry, Path="{0}")
pull = PullPoint(Point=flatten, Geometry=mjoin, ClosestOnly=True)  # -> ClosestPoint, Distance
smaller = SmallerThan(FirstNumber=pull.Distance, SecondNumber=division_2)  # -> SmallerThan, OrEqualTo
cull = CullPattern(List=flatten, CullPattern=smaller.SmallerThan)

meshcp = MeshClosestPoint(Point=flatten, Mesh=mjoin)  # -> Point, Index, Parameter
vec2pt = Vector2Pt(PointA=flatten, PointB=meshcp.Point, Unitize=False)  # -> Vector, Length
meval = MeshEval(Mesh=mjoin, Parameter=meshcp.Parameter)  # -> Point, Normal, Colour
unit = UnitVector(Vector=vec2pt.Vector)
unit_2 = UnitVector(Vector=meval.Normal)
dprod = DotProduct(VectorA=unit_2, VectorB=unit, Unitize=False)
larger = LargerThan(FirstNumber=dprod, SecondNumber=Slider(0.1, range=0..1))  # -> LargerThan, OrEqualTo

reset = ClusterInput()
file = ClusterInput()
c_script = CSharpScript(g=geo, reset=reset)  # -> out, A; inputs g: tree, reset: Boolean
# ---------- c_script: C# ----------
    count++;

    if(reset){
      count = 0;
    }

    A = count.ToString("D10");
# ---------- c_script: C# additional code ----------
  int count = 0;
# ---------- end c_script ----------
txt = Text(file)
concat = Concatenate(FragmentA=txt, FragmentC="-", FragmentB=c_script.A, FragmentD=".mat")

or = GateOr(A=smaller.SmallerThan, B=larger.OrEqualTo)

int_2 = Integer(int)
num_2 = Number(int)
path = ClusterInput()
save = ClusterInput()
int_3 = Integer(or)
gh_cpython = GH_CPython(path=path, file=concat, data=int_3, n=num_2, save=save)  # -> output; inputs path: list, file: list, data: list, n: list, save: list
#   port output: indicate your output description here. refers to a new line.
# ---------- gh_cpython: Python ----------
import numpy as np
import scipy.io

arr = np.empty((0,n,n), int)

count = 0
for i in range(n):
    arrT = np.empty((0,n), int)
    for t in range(n):
        arrS = np.empty((0), int)
        for s in range(n):
            arrS = np.append(arrS, np.array( data[count] ))
            count += 1
        arrT = np.append(arrT,np.array([arrS]), axis=0)
    arr = np.append(arr, np.array([arrT]), axis=0)

output_ = arr

if(save):
    scipy.io.savemat(path + "/" + file, {'instance':arr}, True, '5', False, True)
# ---------- end gh_cpython ----------

cull_2 = CullPattern(List=flatten, CullPattern=or)
output = ClusterOutput(cull_2)
