# Grasshopper definition arabia_b.gh (Grasshopper 1.0.4)
# plug-ins: GH_CPython

背もたれ上端高さ = Slider(2, range=2..6, expression="x*100")
脚形状変化_1 = Slider(0, range=0..4, expression="x*50")
脚形状変化_2 = Slider(-2, range=-2..0, expression="x*50")
基本幅 = Slider(4, range=4..6, expression="x*100")
奥行き = Slider(4, range=4..8, expression="x*100")
addition = Addition(A=脚形状変化_1, B=-50)
addition_2 = Addition(A=脚形状変化_2, B=-50)
pt = ConstructPoint(XCoordinate=脚形状変化_1, YCoordinate=0, ZCoordinate="200")
pt_2 = ConstructPoint(XCoordinate=脚形状変化_2, YCoordinate=0, ZCoordinate="400")
pt_3 = ConstructPoint(XCoordinate=addition, YCoordinate=0, ZCoordinate="200")
pt_4 = ConstructPoint(XCoordinate=addition_2, YCoordinate=0, ZCoordinate="400")
pt_5 = Point(Point(0, 0, 0))
pt_6 = Point(pt)
pt_7 = Point(pt_2)
pt_8 = Point(Point(0, 0, 600))
pt_9 = Point(Point(-20, 0, 0))
pt_10 = Point(pt_3)
pt_11 = Point(pt_4)
pt_12 = Point(Point(-62, 0, 600))
X = UnitX(Factor=1)
line = LineSDL(Start=pt_5, Direction=X, Length=基本幅)
intcrv = Interpolate(Vertices=[pt_9, pt_10, pt_11, pt_12], Degree=3, Periodic=False, KnotStyle=1)  # -> Curve, Length, Domain
intcrv_2 = Interpolate(Vertices=[pt_5, pt_6, pt_7, pt_8], Degree=3, Periodic=False, KnotStyle=1)  # -> Curve, Length, Domain
mid = TK_MidPoint(C=line)  # -> P
# ---------- mid: Python ----------
import rhinoscriptsyntax as rs

if C!=None:
    P=rs.CurveMidPoint(C)
else:
    P=None
# ---------- end mid ----------
crv_cp = CurveClosestPoint(Point=pt_12, Curve=intcrv_2.Curve)  # -> Point, Parameter, Distance
xz = XZPlane(Origin=pt_12)
yz = YZPlane(Origin=mid)
intcrv_3 = Interpolate(Vertices=[pt_5, pt_6, pt_7, crv_cp.Point], Degree=3, Periodic=False, KnotStyle=1)  # -> Curve, Length, Domain
ln = Line(StartPoint=pt_12, EndPoint=crv_cp.Point)
len = Length(Curve=ln)
cir = Circle(Plane=xz, Radius=len)
loft = Loft(
    Curves=[intcrv_3.Curve, intcrv.Curve],
    Options={Adjust=False, Closed=False, LoftEnds=0, LoftSimp=0, LoftType=0, Rebuild=10, Refit=0.01})
circle = Circle(cir)
boundary = BoundarySurfaces(Edges=circle)
rdiff = RegionDifference(CurvesA=loft, CurvesB=boundary)
boundary_2 = BoundarySurfaces(Edges=rdiff)
join = BrepJoin(Breps=[boundary_2, boundary])  # -> Breps, Closed
debrep = DeconstructBrep(Brep=boundary_2)  # -> Faces, Edges, Vertices
Y = UnitY(Factor=奥行き)
item = ListItem(List=debrep.Edges, Index="5", Wrap=True)
mirror = Mirror(Geometry=join.Breps, Plane=yz)  # -> Geometry, Transform
mirror_2 = Mirror(Geometry=item, Plane=yz)  # -> Geometry, Transform
loft_2 = Loft(
    Curves=[item, mirror_2.Geometry],
    Options={Adjust=False, Closed=False, LoftEnds=0, LoftSimp=0, LoftType=0, Rebuild=10, Refit=0.01})
brep = Brep(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)
brep_2 = Brep(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)
split = SplitBrep(Brep=loft_2, Cutter=graft(brep))
item_2 = ListItem(List=split, Index=0, Wrap=True)
split_2 = SplitBrep(Brep=item_2, Cutter=graft(brep_2))
item_3 = ListItem(List=split_2, Index=0, Wrap=True)  # -> Item, Item1
srf = Surface(item_3.Item1)
srf_2 = Surface(item_3.Item)
Y_2 = UnitY(Factor="100")
subtraction = Subtraction(A=奥行き, B="100")
extr = Extrude(Base=srf_2, Direction=Y_2)
Y_3 = UnitY(Factor=subtraction)
debrep_2 = DeconstructBrep(Brep=extr)  # -> Faces, Edges, Vertices
item_4 = ListItem(List=debrep_2.Faces, Index=1, Wrap=True)
Z = UnitZ(Factor=背もたれ上端高さ)
extr_2 = Extrude(Base=[item_4, extr], Direction=Z)
move = Move(Geometry=extr_2, Motion=Y_3)  # -> Geometry, Transform

brep_3 = Brep(<brep referenced from the Rhino model>)  # disabled
bbox = BoundingBox(Content=brep_3, Plane=PlaneXY(0, 0, 0))  # -> Box, Box_2; disabled
debrep_3 = DeconstructBrep(Brep=bbox.Box)  # -> Faces, Edges, Vertices; disabled
panel = Panel(debrep_3.Vertices)  # disabled

extr_3 = Extrude(Base=[join.Breps, mirror.Geometry, srf, move.Geometry], Direction=Y)
brep_4 = Brep(extr_3)

panel_2 = Panel("""基本幅
脚形状変化_1
脚形状変化_2
奥行き
背もたれ上端高さ""")
panel_3 = Panel("動かしたいスライダー名を指定して、Saveボタンをおすと上で指定したディレクトリにmatファイルが連番で保存されます。")
c_script = CSharpScript(sliderNames=panel_2, save=Button())  # -> out; inputs sliderNames: list of String, save: Boolean
# ---------- c_script: C# ----------
    _sliderNames = sliderNames;



    if (!save)
      return;

    if (_running)
      return;


    _run = true;


    GrasshopperDocument.SolutionEnd += OnSolutionEnd;
# ---------- c_script: C# additional code ----------
  private bool _run = false;
  private bool _running = false;
  private List<string> _sliderNames;

  private void OnSolutionEnd(object sender, GH_SolutionEventArgs e)
  {
    // Unregister the event, we don't want to get called again.
    e.Document.SolutionEnd -= OnSolutionEnd;

    // If we're not supposed to run, abort now.
    if (!_run)
      return;

    // If we're already running, abort now.
    if (_running)
      return;
    
    // Reset run and running states.
    _run = false;
    _running = true;

    try
    {
      // Find all sliders.
      List<Grasshopper.Kernel.Special.GH_NumberSlider> sliders = new List<Grasshopper.Kernel.Special.GH_NumberSlider>();

      foreach (IGH_DocumentObject docObject in GrasshopperDocument.Objects)
      {
        Grasshopper.Kernel.Special.GH_NumberSlider slider = docObject as Grasshopper.Kernel.Special.GH_NumberSlider;
        if (slider == null)
          continue;
        sliders.Add(slider);
      }
      if (sliders.Count == 0)
      {
        System.Windows.Forms.MessageBox.Show("No sliders could be found", "<harsh buzzing sound>", MessageBoxButtons.OK);
        return;
      }


      List<bool> contains = new List<bool>();
      List<Grasshopper.Kernel.Special.GH_NumberSlider> filteredSliders = new List<Grasshopper.Kernel.Special.GH_NumberSlider>();
      foreach(Grasshopper.Kernel.Special.GH_NumberSlider slider in sliders){
        if(_sliderNames.Contains(slider.NickName)){
          filteredSliders.Add(slider);
        }

      }
      //A = filteredSliders.Count;

      // Set all sliders back to zero.
      //GH_Document.EnableSolutions = false;
      foreach (Grasshopper.Kernel.Special.GH_NumberSlider slider in filteredSliders)
        slider.TickValue = 0;

      while (true)
      {
        int idx = 0;
        if (!MoveToNextPermutation(ref idx, filteredSliders))
          break;

        // We've just got a new valid permutation. Solve the new solution.
        e.Document.NewSolution(false);
        Rhino.RhinoDoc.ActiveDoc.Views.Redraw();

      }

    }
    catch(Exception ex)
    {
      // Ehm, exception, best swallow it here lest it totally crashes everything.
    }
    finally
    {
      // Always make sure that _running is switched off.
      _running = false;
    }


    
  }

  private bool MoveToNextPermutation(ref int index, List<Grasshopper.Kernel.Special.GH_NumberSlider> filteredSliders)
  {
    if (index >= filteredSliders.Count)
      return false;

    Grasshopper.Kernel.Special.GH_NumberSlider slider = filteredSliders[index];
    if (slider.TickValue < slider.TickCount)
    {
      // Increment the slider.
      slider.TickValue++;
      return true;
    }
    else
    {
      // The current slider is already at the maximum value. Reset it back to zero.
      slider.TickValue = 0;

      // Move on to the next slider.
      index++;

      // If we've run out of sliders to modify, we're done permutatin'
      if (index >= filteredSliders.Count)
        return false;

      return MoveToNextPermutation(ref index, filteredSliders);
    }
  }
# ---------- end c_script ----------

panel_4 = Panel("""基本奥行き
肘掛け高さ""")
panel_5 = Panel("C:/Users/RFA4/Desktop/G_Chair_mat/train_sample/arabia_b")

# ----
# Path: Matファイルを保存するディレクトリ
# Size:バウンディングボックスの横・縦・高さの大きさ
# Resolution：分割数（ShapeNetsの分割数が30なので、30がいいと思います）
# Save: TrueでMatが保存されます。
# File: ファイルの名前です
# Reset: 連番のリセット
# "F:/odrive/Google Drive/JH/Projects/[096] Deep Learning Chair/02. projects/saved_data"
geo = Geometry(flatten(brep_4))
number_slider = Slider(1200, range=0..1500)
number_slider_2 = Slider(30, range=0..100)
cluster = Cluster(
    geometry=geo,
    path=panel_5,
    size=number_slider,
    resolution=number_slider_2,
    save=Toggle(False),
    file="chair_arabia_b",
    reset=Button())

int = Integer(Slider(16, range=0..100))

range = Range(Domain=number_slider, Steps=expr("x-1", simplify(number_slider_2)))
pt_13 = ConstructPoint(XCoordinate=range, YCoordinate=0, ZCoordinate=0)
gh_cpython = GH_CPython(path=panel_5, file="chair_arabia_b", num=int, load=Button())  # -> output, a; inputs path: list, file: list, num: list, load: list
#   port path: [required] - [type = int] - [default = None] Descripe your input here * bullet point. * bullet point
#   port output: indicate your output description here. refers to a new line.
# ---------- gh_cpython: Python ----------
import scipy.io
import Grasshopper as gh

numformat =  str('{:010d}'.format(num))
mat = scipy.io.loadmat(path + "/" + file + "-" + numformat)

#output_ = numformat



output_ = mat["instance"].tolist()

a = mat["instance"]
# ---------- end gh_cpython ----------
graft = GraftTree(Tree=pt_13, IncludeEmptyLists=True, IncludeNullItems=True)
Y_4 = UnitY(Factor=range)
panel_6 = Panel("保存したMatを確認するためのデフィニションです。")
move_2 = Move(Geometry=graft, Motion=Y_4)  # -> Geometry, Transform
c_script_2 = CSharpScript(x=gh_cpython.output, n=number_slider_2)  # -> out, A; inputs x: list of Int32, n: Int32
# ---------- c_script_2: C# ----------
    DataTree<int> tree = new DataTree<int>();

    int count = 0;
    for(int i = 0; i < n; i++){
      for(int s = 0; s < n; s++){
        for(int t = 0; t < n; t++){
          GH_Path path = new GH_Path(i, s,t);
          tree.Add(x[count], path);

          count++;
        }
      }
    }

    A = tree;
# ---------- end c_script_2 ----------
graft_2 = GraftTree(Tree=move_2.Geometry, IncludeEmptyLists=True, IncludeNullItems=True)
Z_2 = UnitZ(Factor=range)
item_5 = ListItem(List=range, Index=1, Wrap=True)
move_3 = Move(Geometry=graft_2, Motion=Z_2)  # -> simplify(Geometry), Transform
division = Division(A=item_5, B=2)
graft_3 = GraftTree(Tree=move_3.Geometry, IncludeEmptyLists=True, IncludeNullItems=True)  # -> simplify(Tree)
cull = CullPattern(List=graft_3, CullPattern=c_script_2.A)
box = CenterBox(Base=cull, X=division, Y=division, Z=division)

preview = CustomPreview(Geometry=box, Material=ColourSwatch(SwatchColor=RGB(102, 168, 255)))

# ==== cluster Cluster
resolution = ClusterInput()
size = ClusterInput()
geometry = ClusterInput()
int = Integer(resolution)

num = Number(size)
geo = Geometry(flatten(geometry))
range = Range(Domain=num, Steps=expr("x-1", simplify(int)))
bbox = BoundingBox(Content=geo, Plane=PlaneXY(0, 0, 0), UnionBox=True)  # -> Box, Box_2
area = Area(Geometry=bbox.Box)  # -> Area, Centroid
pt = ConstructPoint(XCoordinate=range, YCoordinate=0, ZCoordinate=0)  # -> simplify(graft(Point))
pt_2 = ConstructPoint(XCoordinate=num, YCoordinate=num, ZCoordinate=0)
pt_3 = ConstructPoint(XCoordinate=num, YCoordinate=num, ZCoordinate=num)
pt_4 = ConstructPoint(XCoordinate=0, YCoordinate=0, ZCoordinate=0)
pdecon = Deconstruct(Point=area.Centroid)  # -> XComponent, YComponent, ZComponent
division = Division(A=pt_2, B=2)
box = Box2Pt(PointA=pt_4, PointB=pt_3, Plane=PlaneXY(0, 0, 0))
Z = UnitZ(Factor=range)
pt_5 = ConstructPoint(XCoordinate=pdecon.XComponent, YCoordinate=pdecon.YComponent, ZCoordinate=0)
item = ListItem(List=range, Index=1, Wrap=True)
orient = Orient(Geometry=geo, Source=pt_5, Target=division)  # -> Geometry, Transform
division_2 = Division(A=item, B=2.01)
mesh = Mesh(orient.Geometry)
mjoin = MeshJoin(Meshes=mesh)

Y = UnitY(Factor=range)
move = Move(Geometry=pt, Motion=Y)  # -> graft(Geometry), Transform

move_2 = Move(Geometry=move.Geometry, Motion=Z)  # -> Geometry, Transform
flatten = FlattenTree(Tree=move_2.Geometry, Path="{0}")
pull = PullPoint(Point=flatten, Geometry=mjoin, ClosestOnly=True)  # -> ClosestPoint, Distance
smaller = SmallerThan(FirstNumber=pull.Distance, SecondNumber=division_2)  # -> SmallerThan, OrEqualTo
cull = CullPattern(List=flatten, CullPattern=smaller.SmallerThan)

meshcp = MeshClosestPoint(Point=flatten, Mesh=mjoin)  # -> Point, Index, Parameter
vec2pt = Vector2Pt(PointA=flatten, PointB=meshcp.Point, Unitize=False)  # -> Vector, Length
meval = MeshEval(Mesh=mjoin, Parameter=meshcp.Parameter)  # -> Point, Normal, Colour
unit = UnitVector(Vector=vec2pt.Vector)
unit_2 = UnitVector(Vector=meval.Normal)
dprod = DotProduct(VectorA=unit_2, VectorB=unit, Unitize=False)
larger = LargerThan(FirstNumber=dprod, SecondNumber=Slider(0.1, range=0..1))  # -> LargerThan, OrEqualTo

reset = ClusterInput()
file = ClusterInput()
c_script = CSharpScript(g=geo, reset=reset)  # -> out, A; inputs g: tree, reset: Boolean
# ---------- c_script: C# ----------
    count++;

    if(reset){
      count = 0;
    }

    A = count.ToString("D10");
# ---------- c_script: C# additional code ----------
  int count = 0;
# ---------- end c_script ----------
txt = Text(file)
concat = Concatenate(FragmentA=txt, FragmentC="-", FragmentB=c_script.A, FragmentD=".mat")

or = GateOr(A=smaller.SmallerThan, B=larger.OrEqualTo)

int_2 = Integer(int)
num_2 = Number(int)
path = ClusterInput()
save = ClusterInput()
int_3 = Integer(or)
gh_cpython = GH_CPython(path=path, file=concat, data=int_3, n=num_2, save=save)  # -> output; inputs path: list, file: list, data: list, n: list, save: list
#   port output: indicate your output description here. refers to a new line.
# ---------- gh_cpython: Python ----------
import numpy as np
import scipy.io

arr = np.empty((0,n,n), int)

count = 0
for i in range(n):
    arrT = np.empty((0,n), int)
    for t in range(n):
        arrS = np.empty((0), int)
        for s in range(n):
            arrS = np.append(arrS, np.array( data[count] ))
            count += 1
        arrT = np.append(arrT,np.array([arrS]), axis=0)
    arr = np.append(arr, np.array([arrT]), axis=0)

output_ = arr

if(save):
    scipy.io.savemat(path + "/" + file, {'instance':arr}, True, '5', False, True)
# ---------- end gh_cpython ----------

cull_2 = CullPattern(List=flatten, CullPattern=or)
output = ClusterOutput(cull_2)
