# Grasshopper definition chinese_a.gh (Grasshopper 0.9.76)

背もたれ上端高さ = Slider(5, range=5..7, expression="x*100")
肘掛け幅 = Slider(1, range=1..3, expression="x*40")
肘掛け角丸 = Slider(0, range=0..2, expression="x*60")
背もたれ角度 = Slider(0, range=0..2, expression="x*-10")
基本奥行き = Slider(4, range=4..6, expression="x*100")
肘掛け高さ = Slider(4, range=4..6, expression="x*100")
座面高さ = Slider(3, range=3..4, expression="x*100")
基本幅 = Slider(4, range=4..6, expression="x*100")
yz = YZPlane(Origin=Point(0, 0, 0))
X = UnitX(Factor=基本幅)
rectangle = Rectangle(Plane=yz, XSize=基本奥行き, YSize=肘掛け高さ, Radius=肘掛け角丸)  # -> Rectangle, Length
move = Move(Geometry=rectangle.Rectangle, Motion=X)  # -> Geometry, Transform
yz_2 = YZPlane(Origin=Point(0, 0, 0))
crv = Curve([rectangle.Rectangle, move.Geometry])
offset = Offset(Curve=crv, Distance="-30", Plane=yz_2, Corners=1)
graft = GraftTree(Tree=crv, IncludeEmptyLists=True, IncludeNullItems=True)
graft_2 = GraftTree(Tree=offset, IncludeEmptyLists=True, IncludeNullItems=True)
rulesrf = RuledSurface(CurveA=graft, CurveB=graft_2)
X_2 = UnitX(Factor=肘掛け幅)
extr = Extrude(Base=rulesrf, Direction=X_2)
bbox = BoundingBox(Content=extr, Plane=PlaneXY(0, 0, 0))  # -> Box, Box_2
bang = ExplodeTree(Data=bbox.Box)  # -> _0000, _0100
debrep = DeconstructBrep(Brep=bang._0000)  # -> Faces, Edges, Vertices
debrep_2 = DeconstructBrep(Brep=bang._0100)  # -> Faces, Edges, Vertices
devec = DeconstructVector(Vector=debrep.Vertices)  # -> XComponent, YComponent, ZComponent
devec_2 = DeconstructVector(Vector=debrep_2.Vertices)  # -> XComponent, YComponent, ZComponent
sort = SortList(Keys=devec.XComponent)  # -> Keys, ValuesA
sort_2 = SortList(Keys=devec_2.XComponent)  # -> Keys, ValuesA
rev = ReverseList(List=sort.Keys)
item = ListItem(List=rev, Index=0, Wrap=True)
item_2 = ListItem(List=sort_2.Keys, Index=0, Wrap=True)
pt = ConstructPoint(XCoordinate=item, YCoordinate=0, ZCoordinate=0)
subtraction = Subtraction(A=item_2, B=item)
rectangle_2 = Rectangle(Plane=pt, XSize=subtraction, YSize=基本奥行き, Radius=0)  # -> Rectangle, Length
Z = UnitZ(Factor=座面高さ)
move_2 = Move(Geometry=rectangle_2.Rectangle, Motion=Z)  # -> Geometry, Transform
Z_2 = UnitZ(Factor="-30")
boundary = BoundarySurfaces(Edges=move_2.Geometry)
extr_2 = Extrude(Base=boundary, Direction=Z_2)
debrep_3 = DeconstructBrep(Brep=extr_2)  # -> Faces, Edges, Vertices
item_3 = ListItem(List=debrep_3.Edges, Index="9", Wrap=True)
Z_3 = UnitZ(Factor=背もたれ上端高さ)
crv_2 = Curve(item_3)
c_script = CSharpScript(folder="C:\ParametricImages\", makeimages=Button())  # -> out, A; inputs folder: String, makeimages: Boolean
# ---------- c_script: C# ----------
    if (!makeimages)
      return;

    if (_running)
      return;

    if (!System.IO.Directory.Exists(folder))
      System.IO.Directory.CreateDirectory(folder);

    _folder = folder;
    _run = true;
    GrasshopperDocument.SolutionEnd += OnSolutionEnd;
# ---------- c_script: C# additional code ----------
  private bool _run = false;
  private bool _running = false;
  private string _folder;

  private void OnSolutionEnd(object sender, GH_SolutionEventArgs e)
  {
    // Unregister the event, we don't want to get called again.
    e.Document.SolutionEnd -= OnSolutionEnd;

    // If we're not supposed to run, abort now.
    if (!_run)
      return;

    // If we're already running, abort now.
    if (_running)
      return;

    // Reset run and running states.
    _run = false;
    _running = true;

    try
    {
      // Find all sliders.
      List<Grasshopper.Kernel.Special.GH_NumberSlider> sliders = new List<Grasshopper.Kernel.Special.GH_NumberSlider>();
      foreach (IGH_DocumentObject docObject in GrasshopperDocument.Objects)
      {
        Grasshopper.Kernel.Special.GH_NumberSlider slider = docObject as Grasshopper.Kernel.Special.GH_NumberSlider;
        if (slider == null)
          continue;
        sliders.Add(slider);
      }
      if (sliders.Count == 0)
      {
        System.Windows.Forms.MessageBox.Show("No sliders could be found", "<harsh buzzing sound>", MessageBoxButtons.OK);
        return;
      }

      // Set all sliders back to zero.
      //GH_Document.EnableSolutions = false;
      foreach (Grasshopper.Kernel.Special.GH_NumberSlider slider in sliders)
        slider.TickValue = 0;

      // Start a giant loop in which we'll permutate our way across all slider layouts.
      int imageNumber = 0;
      while (true)
      {
        int idx = 0;
        if (!MoveToNextPermutation(ref idx, sliders))
          break;

        // We've just got a new valid permutation. Solve the new solution.
        e.Document.NewSolution(false);
        Rhino.RhinoDoc.ActiveDoc.Views.Redraw();

        Rhino.Display.RhinoView view = RhinoDocument.Views.Find("Perspective", false);
        if (view == null)
          break;

        string fileName = string.Format("{0}\\{1}.png", _folder, imageNumber);
        imageNumber++;

        Bitmap image = view.CaptureToBitmap();
        if (image == null)
          continue;

        image.Save(fileName);
        image.Dispose();
        image = null;
      }
    }
    catch(Exception ex)
    {
      // Ehm, exception, best swallow it here lest it totally crashes everything.
    }
    finally
    {
      // Always make sure that _running is switched off.
      _running = false;
    }
  }

  private bool MoveToNextPermutation(ref int index, List<Grasshopper.Kernel.Special.GH_NumberSlider> sliders)
  {
    if (index >= sliders.Count)
      return false;

    Grasshopper.Kernel.Special.GH_NumberSlider slider = sliders[index];
    if (slider.TickValue < slider.TickCount)
    {
      // Increment the slider.
      slider.TickValue++;
      return true;
    }
    else
    {
      // The current slider is already at the maximum value. Reset it back to zero.
      slider.TickValue = 0;

      // Move on to the next slider.
      index++;

      // If we've run out of sliders to modify, we're done permutatin'
      if (index >= sliders.Count)
        return false;

      return MoveToNextPermutation(ref index, sliders);
    }
  }
# ---------- end c_script ----------
move_3 = Move(Geometry=crv_2, Motion=Z_3)  # -> Geometry, Transform
end = EndPoints(Curve=crv_2)  # -> Start, End
loft = Loft(
    Curves=[crv_2, move_3.Geometry],
    Options={Adjust=False, Closed=False, LoftEnds=0, LoftSimp=0, LoftType=0, Rebuild=10, Refit=0.01})
Y = UnitY(Factor="-30")
yz_3 = YZPlane(Origin=end.End)
num = Number(expr("rad(x)", 背もたれ角度))
extr_3 = Extrude(Base=loft, Direction=Y)
rotate = Rotate(Geometry=extr_3, Angle=num, Plane=yz_3)  # -> Geometry, Transform
brep = Brep([extr, extr_2, rotate.Geometry])
