# Grasshopper definition chinese_b.gh (Grasshopper 1.0.4)
# plug-ins: MeshEdit Components, Weaverbird, GH_CPython

座面高さ = Slider(4, range=4..5, expression="x*100")
脚太さ_座面厚み = Slider(2, range=2..4, expression="x*10")
背もたれ抜き高さ = Slider(1, range=1..4, expression="x*0.2")
背もたれ上端高さ = Slider(4, range=4..6, expression="x*100")
背もたれ抜き幅 = Slider(0, range=0..5, expression="x*0.2")
基本奥行 = Slider(2, range=2..3, expression="x*200")
基本幅 = Slider(2, range=2..5, expression="x*200")
vec = VectorXYZ(XComponent=基本幅, YComponent=基本奥行, ZComponent=座面高さ)  # -> Vector, Length
division = Division(A=脚太さ_座面厚み, B=-2)
pt = Point(Point(0, 0, 0))
pt_2 = ConstructPoint(XCoordinate=division, YCoordinate=division, ZCoordinate=0)
box = Box2Pt(PointA=pt, PointB=vec.Vector, Plane=PlaneXY(0, 0, 0))
mesh = MeshBrep(
    Brep=box,
    Settings={GridMaxCount=0, GridMinCount=16, JaggedSeams=False, MaxEdgeLength=0, MinEdgeLength=0.0001, MinTolerance=0, Refine=True, RefineAngle=0, RelativeTolerance=0.65, SimplePlanes=True, Tolerance=0})
rectangle = Rectangle(Plane=pt_2, XSize=脚太さ_座面厚み, YSize=脚太さ_座面厚み, Radius=0)  # -> Rectangle, Length
wbedges = WeaverbirdsMeshEdges(MeshOrPolylines=mesh)
explode = MeshExplode(Mesh=mesh, Interpolate=False)
panel = Panel("""0
2
5
8""")
item = ListItem(List=explode, Index="4", Wrap=True)  # -> Item, Item1
item_2 = ListItem(List=wbedges, Index=panel, Wrap=True)
mesh_2 = Mesh(item.Item)
orient = Orient(Geometry=rectangle.Rectangle, Source=PlaneXY(0, 0, 0), Target=item_2)  # -> Geometry, Transform
extrude = ExtrudeLinear(Profile=orient.Geometry, OrientationP=orient.Geometry, Axis=item_2, OrientationA=orient.Geometry)
wbedges_2 = WeaverbirdsMeshEdges(MeshOrPolylines=mesh_2)
Z = UnitZ(Factor="50")
join = JoinCurves(Curves=wbedges_2, Preserve=False)
Z_2 = UnitZ(Factor=座面高さ)
move = Move(Geometry=join, Motion=Z)  # -> Geometry, Transform
multiplication = Multiplication(A=脚太さ_座面厚み, B=0.5)
multiplication_2 = Multiplication(A=脚太さ_座面厚み, B=-0.5)
multiplication_3 = Multiplication(A=脚太さ_座面厚み, B=-0.5)
move_2 = Move(Geometry=join, Motion=Z_2)  # -> Geometry, Transform
join_2 = JoinCurves(Curves=move_2.Geometry, Preserve=False)
offset = Offset(Curve=move.Geometry, Distance=graft([multiplication, multiplication_2]), Plane=PlaneXY(0, 0, 0), Corners=1)
offset_2 = Offset(Curve=join_2, Distance=multiplication_3, Plane=PlaneXY(0, 0, 0), Corners=1)
bang = ExplodeTree(Data=offset)  # -> _0000, _0010
boundary = BoundarySurfaces(Edges=offset_2)
Z_3 = UnitZ(Factor=脚太さ_座面厚み)
boundary_2 = BoundarySurfaces(Edges=flatten([bang._0000, bang._0010]))
Z_4 = UnitZ(Factor=脚太さ_座面厚み)
extr = Extrude(Base=boundary, Direction=Z_3)
extr_2 = Extrude(Base=boundary_2, Direction=Z_4)
debrep = DeconstructBrep(Brep=extr)  # -> Faces, Edges, Vertices
item_3 = ListItem(List=debrep.Vertices, Index="9", Wrap=True)  # -> Item, Item1
Z_5 = UnitZ(Factor=背もたれ上端高さ)
move_3 = Move(Geometry=[item_3.Item, item_3.Item1], Motion=Z_5)  # -> Geometry, Transform
item_4 = ListItem(List=move_3.Geometry, Index=0, Wrap=True)  # -> Item, Item1
division_2 = Division(A=脚太さ_座面厚み, B=2)
ln = Line(StartPoint=item_3.Item, EndPoint=item_3.Item1)
X = UnitX(Factor=division_2)
mid = TK_MidPoint(C=ln)  # -> P
# ---------- mid: Python ----------
import rhinoscriptsyntax as rs

if C!=None:
    P=rs.CurveMidPoint(C)
else:
    P=None
# ---------- end mid ----------
cap = CapHoles(Brep=extrude)
trim = TrimSolid(Shape=extr_2, Cutters=cap)
srf4pt = _4PointSurface(CornerA=item_3.Item, CornerB=item_3.Item1, CornerC=item_4.Item1, CornerD=item_4.Item)
ln_2 = Line(StartPoint=item_3.Item, EndPoint=mid)
eval = EvaluateCurve(Curve=ln_2, Parameter=背もたれ抜き幅)  # -> Point, Tangent, Angle
move_4 = Move(Geometry=item_3.Item, Motion=X)  # -> Geometry, Transform
Z_6 = UnitZ(Factor=1)
ln_3 = Line(StartPoint=eval.Point, EndPoint=move_4.Geometry)
xz = XZPlane(Origin=eval.Point)
multiplication_4 = Multiplication(A=背もたれ上端高さ, B=背もたれ抜き高さ)
line = LineSDL(Start=mid, Direction=Z_6, Length=1)
len = Length(Curve=ln_3)  # -> expr("x*-1", Length)
rectangle_2 = Rectangle(Plane=xz, XSize=len, YSize=multiplication_4, Radius=0)  # -> Rectangle, Length
mirror = MirrorCurve(Geometry=rectangle_2.Rectangle, Curve=line, Tangent=True)
crv = Curve(flatten([rectangle_2.Rectangle, mirror]))
rdiff = RegionDifference(CurvesA=srf4pt, CurvesB=crv)
Y = UnitY(Factor=expr("x*(-1)", 脚太さ_座面厚み))
boundary_3 = BoundarySurfaces(Edges=rdiff)

brep = Brep(<brep referenced from the Rhino model>)  # disabled
bbox = BoundingBox(Content=brep, Plane=PlaneXY(0, 0, 0))  # -> Box, Box_2; disabled
number_slider = Slider(6, range=0..20)  # disabled
debrep_2 = DeconstructBrep(Brep=bbox.Box)  # -> Faces, Edges, Vertices; disabled
item_5 = ListItem(List=debrep_2.Vertices, Index=number_slider, Wrap=True)  # disabled

extr_3 = Extrude(Base=boundary_3, Direction=Y)
join_3 = BrepJoin(Breps=[trim, cap, extr, extr_3])  # -> Breps, Closed
brep_2 = Brep(join_3.Breps)

panel_2 = Panel("""基本幅
基本奥行
座面高さ
脚太さ・座面厚み
背もたれ抜き幅
背もたれ抜き高さ
背もたれ上端高さ""")
panel_3 = Panel("動かしたいスライダー名を指定して、Saveボタンをおすと上で指定したディレクトリにmatファイルが連番で保存されます。")
c_script = CSharpScript(sliderNames=panel_2, save=Button())  # -> out; inputs sliderNames: list of String, save: Boolean
# ---------- c_script: C# ----------
    _sliderNames = sliderNames;



    if (!save)
      return;

    if (_running)
      return;


    _run = true;


    GrasshopperDocument.SolutionEnd += OnSolutionEnd;
# ---------- c_script: C# additional code ----------
  private bool _run = false;
  private bool _running = false;
  private List<string> _sliderNames;

  private void OnSolutionEnd(object sender, GH_SolutionEventArgs e)
  {
    // Unregister the event, we don't want to get called again.
    e.Document.SolutionEnd -= OnSolutionEnd;

    // If we're not supposed to run, abort now.
    if (!_run)
      return;

    // If we're already running, abort now.
    if (_running)
      return;
    
    // Reset run and running states.
    _run = false;
    _running = true;

    try
    {
      // Find all sliders.
      List<Grasshopper.Kernel.Special.GH_NumberSlider> sliders = new List<Grasshopper.Kernel.Special.GH_NumberSlider>();

      foreach (IGH_DocumentObject docObject in GrasshopperDocument.Objects)
      {
        Grasshopper.Kernel.Special.GH_NumberSlider slider = docObject as Grasshopper.Kernel.Special.GH_NumberSlider;
        if (slider == null)
          continue;
        sliders.Add(slider);
      }
      if (sliders.Count == 0)
      {
        System.Windows.Forms.MessageBox.Show("No sliders could be found", "<harsh buzzing sound>", MessageBoxButtons.OK);
        return;
      }


      List<bool> contains = new List<bool>();
      List<Grasshopper.Kernel.Special.GH_NumberSlider> filteredSliders = new List<Grasshopper.Kernel.Special.GH_NumberSlider>();
      foreach(Grasshopper.Kernel.Special.GH_NumberSlider slider in sliders){
        if(_sliderNames.Contains(slider.NickName)){
          filteredSliders.Add(slider);
        }

      }
      //A = filteredSliders.Count;

      // Set all sliders back to zero.
      //GH_Document.EnableSolutions = false;
      foreach (Grasshopper.Kernel.Special.GH_NumberSlider slider in filteredSliders)
        slider.TickValue = 0;

      while (true)
      {
        int idx = 0;
        if (!MoveToNextPermutation(ref idx, filteredSliders))
          break;

        // We've just got a new valid permutation. Solve the new solution.
        e.Document.NewSolution(false);
        Rhino.RhinoDoc.ActiveDoc.Views.Redraw();

      }

    }
    catch(Exception ex)
    {
      // Ehm, exception, best swallow it here lest it totally crashes everything.
    }
    finally
    {
      // Always make sure that _running is switched off.
      _running = false;
    }


    
  }

  private bool MoveToNextPermutation(ref int index, List<Grasshopper.Kernel.Special.GH_NumberSlider> filteredSliders)
  {
    if (index >= filteredSliders.Count)
      return false;

    Grasshopper.Kernel.Special.GH_NumberSlider slider = filteredSliders[index];
    if (slider.TickValue < slider.TickCount)
    {
      // Increment the slider.
      slider.TickValue++;
      return true;
    }
    else
    {
      // The current slider is already at the maximum value. Reset it back to zero.
      slider.TickValue = 0;

      // Move on to the next slider.
      index++;

      // If we've run out of sliders to modify, we're done permutatin'
      if (index >= filteredSliders.Count)
        return false;

      return MoveToNextPermutation(ref index, filteredSliders);
    }
  }
# ---------- end c_script ----------

panel_4 = Panel("C:/Users/RFA4/Desktop/G_Chair_mat/train_sample/chinese_b")

# ----
# Path: Matファイルを保存するディレクトリ
# Size:バウンディングボックスの横・縦・高さの大きさ
# Resolution：分割数（ShapeNetsの分割数が30なので、30がいいと思います）
# Save: TrueでMatが保存されます。
# File: ファイルの名前です
# Reset: 連番のリセット
# "F:/odrive/Google Drive/JH/Projects/[096] Deep Learning Chair/02. projects/saved_data"
geo = Geometry(flatten(brep_2))
number_slider_2 = Slider(1200, range=0..1500)
number_slider_3 = Slider(30, range=0..100)
cluster = Cluster(
    geometry=geo,
    path=panel_4,
    size=number_slider_2,
    resolution=number_slider_3,
    save=Toggle(False),
    file="chair_chinese_b",
    reset=Button())

int = Integer(Slider(97, range=0..100))

range = Range(Domain=number_slider_2, Steps=expr("x-1", simplify(number_slider_3)))
pt_3 = ConstructPoint(XCoordinate=range, YCoordinate=0, ZCoordinate=0)
gh_cpython = GH_CPython(path=panel_4, file="chair_chinese_b", num=int, load=Button())  # -> output, a; inputs path: list, file: list, num: list, load: list
#   port path: [required] - [type = int] - [default = None] Descripe your input here * bullet point. * bullet point
#   port output: indicate your output description here. refers to a new line.
# ---------- gh_cpython: Python ----------
import scipy.io
import Grasshopper as gh

numformat =  str('{:010d}'.format(num))
mat = scipy.io.loadmat(path + "/" + file + "-" + numformat)

#output_ = numformat



output_ = mat["instance"].tolist()

a = mat["instance"]
# ---------- end gh_cpython ----------
graft = GraftTree(Tree=pt_3, IncludeEmptyLists=True, IncludeNullItems=True)
Y_2 = UnitY(Factor=range)
panel_5 = Panel("保存したMatを確認するためのデフィニションです。")
move_5 = Move(Geometry=graft, Motion=Y_2)  # -> Geometry, Transform
c_script_2 = CSharpScript(x=gh_cpython.output, n=number_slider_3)  # -> out, A; inputs x: list of Int32, n: Int32
# ---------- c_script_2: C# ----------
    DataTree<int> tree = new DataTree<int>();

    int count = 0;
    for(int i = 0; i < n; i++){
      for(int s = 0; s < n; s++){
        for(int t = 0; t < n; t++){
          GH_Path path = new GH_Path(i, s,t);
          tree.Add(x[count], path);

          count++;
        }
      }
    }

    A = tree;
# ---------- end c_script_2 ----------
graft_2 = GraftTree(Tree=move_5.Geometry, IncludeEmptyLists=True, IncludeNullItems=True)
Z_7 = UnitZ(Factor=range)
item_6 = ListItem(List=range, Index=1, Wrap=True)
move_6 = Move(Geometry=graft_2, Motion=Z_7)  # -> simplify(Geometry), Transform
division_3 = Division(A=item_6, B=2)
graft_3 = GraftTree(Tree=move_6.Geometry, IncludeEmptyLists=True, IncludeNullItems=True)  # -> simplify(Tree)
cull = CullPattern(List=graft_3, CullPattern=c_script_2.A)
box_2 = CenterBox(Base=cull, X=division_3, Y=division_3, Z=division_3)

preview = CustomPreview(Geometry=box_2, Material=ColourSwatch(SwatchColor=RGB(102, 168, 255)))

# ==== cluster Cluster
resolution = ClusterInput()
size = ClusterInput()
geometry = ClusterInput()
int = Integer(resolution)

num = Number(size)
geo = Geometry(flatten(geometry))
range = Range(Domain=num, Steps=expr("x-1", simplify(int)))
bbox = BoundingBox(Content=geo, Plane=PlaneXY(0, 0, 0), UnionBox=True)  # -> Box, Box_2
area = Area(Geometry=bbox.Box)  # -> Area, Centroid
pt = ConstructPoint(XCoordinate=range, YCoordinate=0, ZCoordinate=0)  # -> simplify(graft(Point))
pt_2 = ConstructPoint(XCoordinate=num, YCoordinate=num, ZCoordinate=0)
pt_3 = ConstructPoint(XCoordinate=num, YCoordinate=num, ZCoordinate=num)
pt_4 = ConstructPoint(XCoordinate=0, YCoordinate=0, ZCoordinate=0)
pdecon = Deconstruct(Point=area.Centroid)  # -> XComponent, YComponent, ZComponent
division = Division(A=pt_2, B=2)
box = Box2Pt(PointA=pt_4, PointB=pt_3, Plane=PlaneXY(0, 0, 0))
Z = UnitZ(Factor=range)
pt_5 = ConstructPoint(XCoordinate=pdecon.XComponent, YCoordinate=pdecon.YComponent, ZCoordinate=0)
item = ListItem(List=range, Index=1, Wrap=True)
orient = Orient(Geometry=geo, Source=pt_5, Target=division)  # -> Geometry, Transform
division_2 = Division(A=item, B=2.01)
mesh = Mesh(orient.Geometry)
mjoin = MeshJoin(Meshes=mesh)

Y = UnitY(Factor=range)
move = Move(Geometry=pt, Motion=Y)  # -> graft(Geometry), Transform

move_2 = Move(Geometry=move.Geometry, Motion=Z)  # -> Geometry, Transform
flatten = FlattenTree(Tree=move_2.Geometry, Path="{0}")
pull = PullPoint(Point=flatten, Geometry=mjoin, ClosestOnly=True)  # -> ClosestPoint, Distance
smaller = SmallerThan(FirstNumber=pull.Distance, SecondNumber=division_2)  # -> SmallerThan, OrEqualTo
cull = CullPattern(List=flatten, CullPattern=smaller.SmallerThan)

meshcp = MeshClosestPoint(Point=flatten, Mesh=mjoin)  # -> Point, Index, Parameter
vec2pt = Vector2Pt(PointA=flatten, PointB=meshcp.Point, Unitize=False)  # -> Vector, Length
meval = MeshEval(Mesh=mjoin, Parameter=meshcp.Parameter)  # -> Point, Normal, Colour
unit = UnitVector(Vector=vec2pt.Vector)
unit_2 = UnitVector(Vector=meval.Normal)
dprod = DotProduct(VectorA=unit_2, VectorB=unit, Unitize=False)
larger = LargerThan(FirstNumber=dprod, SecondNumber=Slider(0.1, range=0..1))  # -> LargerThan, OrEqualTo

reset = ClusterInput()
file = ClusterInput()
c_script = CSharpScript(g=geo, reset=reset)  # -> out, A; inputs g: tree, reset: Boolean
# ---------- c_script: C# ----------
    count++;

    if(reset){
      count = 0;
    }

    A = count.ToString("D10");
# ---------- c_script: C# additional code ----------
  int count = 0;
# ---------- end c_script ----------
txt = Text(file)
concat = Concatenate(FragmentA=txt, FragmentC="-", FragmentB=c_script.A, FragmentD=".mat")

or = GateOr(A=smaller.SmallerThan, B=larger.OrEqualTo)

int_2 = Integer(int)
num_2 = Number(int)
path = ClusterInput()
save = ClusterInput()
int_3 = Integer(or)
gh_cpython = GH_CPython(path=path, file=concat, data=int_3, n=num_2, save=save)  # -> output; inputs path: list, file: list, data: list, n: list, save: list
#   port output: indicate your output description here. refers to a new line.
# ---------- gh_cpython: Python ----------
import numpy as np
import scipy.io

arr = np.empty((0,n,n), int)

count = 0
for i in range(n):
    arrT = np.empty((0,n), int)
    for t in range(n):
        arrS = np.empty((0), int)
        for s in range(n):
            arrS = np.append(arrS, np.array( data[count] ))
            count += 1
        arrT = np.append(arrT,np.array([arrS]), axis=0)
    arr = np.append(arr, np.array([arrT]), axis=0)

output_ = arr

if(save):
    scipy.io.savemat(path + "/" + file, {'instance':arr}, True, '5', False, True)
# ---------- end gh_cpython ----------

cull_2 = CullPattern(List=flatten, CullPattern=or)
output = ClusterOutput(cull_2)
