# Grasshopper definition english_a.gh (Grasshopper 0.9.76)

フィレット半径 = Slider(3, range=0..3, expression="x*30")
背もたれ幅 = Slider(1, range=1..3, expression="x*30")
基本幅_奥 = Slider(3, range=0..3, expression="x*30")
背もたれ高さ = Slider(6, range=4..6, expression="x*100")
座面高さ = Slider(4, range=4..6, expression="x*100")
脚径 = Slider(3, range=1..3, expression="x*10")
基本幅 = Slider(5, range=4..6, expression="x*100")
multiplication = Multiplication(A=基本幅_奥, B=1.2)
subtraction = Subtraction(A="400", B=multiplication)
subtraction_2 = Subtraction(A=基本幅, B=multiplication)
subtraction_3 = Subtraction(A=基本幅, B=基本幅_奥)
pt = ConstructPoint(XCoordinate=基本幅, YCoordinate=0, ZCoordinate=0)
pt_2 = ConstructPoint(XCoordinate=基本幅_奥, YCoordinate="400", ZCoordinate=0)
pt_3 = ConstructPoint(XCoordinate=subtraction_3, YCoordinate="400", ZCoordinate=0)
pt_4 = ConstructPoint(XCoordinate=multiplication, YCoordinate=基本幅_奥, ZCoordinate=座面高さ)
pt_5 = ConstructPoint(XCoordinate=subtraction_2, YCoordinate=基本幅_奥, ZCoordinate=座面高さ)
pt_6 = ConstructPoint(XCoordinate=multiplication, YCoordinate=subtraction, ZCoordinate=座面高さ)
pt_7 = ConstructPoint(XCoordinate=subtraction_2, YCoordinate=subtraction, ZCoordinate=座面高さ)
pt_8 = Point("0,0,0")
ln = Line(StartPoint=pt_8, EndPoint=pt_4)
ln_2 = Line(StartPoint=pt_4, EndPoint=pt_6)
ln_3 = Line(StartPoint=pt_2, EndPoint=pt_6)
ln_4 = Line(StartPoint=pt, EndPoint=pt_5)
ln_5 = Line(StartPoint=pt_3, EndPoint=pt_7)
ln_6 = Line(StartPoint=pt_5, EndPoint=pt_7)
join = JoinCurves(Curves=[ln, ln_2, ln_3], Preserve=False)
join_2 = JoinCurves(Curves=[ln_4, ln_5, ln_6], Preserve=False)
fillet = Fillet(Curve=join, Radius=フィレット半径)
fillet_2 = Fillet(Curve=join_2, Radius=フィレット半径)
pt_9 = Point([pt_2, pt_3])
pt_10 = Point([pt_2, pt_3])
pdecon = Deconstruct(Point=pt_9)  # -> XComponent, YComponent, ZComponent
pdecon_2 = Deconstruct(Point=pt_10)  # -> XComponent, YComponent, ZComponent
crv = Curve(fillet)
crv_2 = Curve(fillet_2)
item = ListItem(List=pdecon.XComponent, Index=0, Wrap=True)  # -> Item, Item1
item_2 = ListItem(List=pdecon.YComponent, Index=0, Wrap=True)
item_3 = ListItem(List=pdecon.ZComponent, Index=0, Wrap=True)
addition = Addition(A=pdecon.ZComponent, B="50")
pipe = Pipe(Curve=[crv, crv_2], Radius=脚径, Caps=1)
X = UnitX(Factor=expr("x*-1", 背もたれ幅))
addition_2 = Addition(A=pdecon_2.YComponent, B="150")
addition_3 = Addition(A=pdecon_2.ZComponent, B=背もたれ高さ)
pt_11 = ConstructPoint(XCoordinate=item.Item, YCoordinate=item_2, ZCoordinate=item_3)
pt_12 = ConstructPoint(XCoordinate=item.Item1, YCoordinate=item_2, ZCoordinate=item_3)
X_2 = UnitX(Factor=背もたれ幅)
bang = ExplodeTree(Data=pipe)  # -> Branch0, Branch1
move = Move(Geometry=pt_12, Motion=X_2)  # -> Geometry, Transform
pt_13 = ConstructPoint(XCoordinate=pdecon.XComponent, YCoordinate=pdecon.YComponent, ZCoordinate=addition)
pt_14 = ConstructPoint(XCoordinate=pdecon_2.XComponent, YCoordinate=addition_2, ZCoordinate=addition_3)
move_2 = Move(Geometry=pt_11, Motion=X)  # -> Geometry, Transform
bbox = BoundingBox(Content=bang.Branch0, Plane=PlaneXY(0, 0, 0))  # -> Box, Box_2
debrep = DeconstructBrep(Brep=bbox.Box)  # -> Faces, Edges, Vertices
item_4 = ListItem(List=pt_13, Index=0, Wrap=True)  # -> Item, Item1
item_5 = ListItem(List=pt_14, Index=0, Wrap=True)  # -> Item, Item1
pdecon_3 = Deconstruct(Point=debrep.Vertices)  # -> XComponent, YComponent, ZComponent
merge = Merge(Data1=pt_8, Data2=pt, Data3=move.Geometry, Data4=item_5.Item1, Data5=item_5.Item, Data6=move_2.Geometry)
sort = SortList(Keys=pdecon_3.ZComponent)  # -> Keys, ValuesA
rev = ReverseList(List=sort.Keys)
intcrv = Interpolate(Vertices=merge, Degree=3, Periodic=True, KnotStyle=1)  # -> Curve, Length, Domain
item_6 = ListItem(List=rev, Index=0, Wrap=True)
patch = Patch(Curves=intcrv.Curve, Spans="3", Flexibility="5", Trim=True)
offset = Offset(Surface=patch, Distance="10", Retrim=True)
loft = Loft(Curves=[offset, patch], Options={Adjust=False, Closed=False, LoftEnds=0, LoftSimp=0, LoftType=0, Rebuild=10, Refit=0.01})
join_3 = BrepJoin(Breps=[loft, patch, offset])  # -> Breps, Closed
bbox_2 = BoundingBox(Content=join_3.Breps, Plane=PlaneXY(0, 0, 0))  # -> Box, Box_2
debrep_2 = DeconstructBrep(Brep=bbox_2.Box)  # -> Faces, Edges, Vertices
pdecon_4 = Deconstruct(Point=debrep_2.Vertices)  # -> XComponent, YComponent, ZComponent
sort_2 = SortList(Keys=pdecon_4.ZComponent)  # -> Keys, ValuesA
item_7 = ListItem(List=sort_2.Keys, Index=0, Wrap=True)
multiplication_2 = Multiplication(A=item_7, B=-0.7)
addition_4 = Addition(A=item_6, B=multiplication_2)
Z = UnitZ(Factor=addition_4)
c_script = CSharpScript(folder="C:\ParametricImages\", makeimages=Button())  # -> out, A; inputs folder: String, makeimages: Boolean
# ---------- c_script: C# ----------
    if (!makeimages)
      return;

    if (_running)
      return;

    if (!System.IO.Directory.Exists(folder))
      System.IO.Directory.CreateDirectory(folder);

    _folder = folder;
    _run = true;
    GrasshopperDocument.SolutionEnd += OnSolutionEnd;
# ---------- c_script: C# additional code ----------
  private bool _run = false;
  private bool _running = false;
  private string _folder;

  private void OnSolutionEnd(object sender, GH_SolutionEventArgs e)
  {
    // Unregister the event, we don't want to get called again.
    e.Document.SolutionEnd -= OnSolutionEnd;

    // If we're not supposed to run, abort now.
    if (!_run)
      return;

    // If we're already running, abort now.
    if (_running)
      return;

    // Reset run and running states.
    _run = false;
    _running = true;

    try
    {
      // Find all sliders.
      List<Grasshopper.Kernel.Special.GH_NumberSlider> sliders = new List<Grasshopper.Kernel.Special.GH_NumberSlider>();
      foreach (IGH_DocumentObject docObject in GrasshopperDocument.Objects)
      {
        Grasshopper.Kernel.Special.GH_NumberSlider slider = docObject as Grasshopper.Kernel.Special.GH_NumberSlider;
        if (slider == null)
          continue;
        sliders.Add(slider);
      }
      if (sliders.Count == 0)
      {
        System.Windows.Forms.MessageBox.Show("No sliders could be found", "<harsh buzzing sound>", MessageBoxButtons.OK);
        return;
      }

      // Set all sliders back to zero.
      //GH_Document.EnableSolutions = false;
      foreach (Grasshopper.Kernel.Special.GH_NumberSlider slider in sliders)
        slider.TickValue = 0;

      // Start a giant loop in which we'll permutate our way across all slider layouts.
      int imageNumber = 0;
      while (true)
      {
        int idx = 0;
        if (!MoveToNextPermutation(ref idx, sliders))
          break;

        // We've just got a new valid permutation. Solve the new solution.
        e.Document.NewSolution(false);
        Rhino.RhinoDoc.ActiveDoc.Views.Redraw();

        Rhino.Display.RhinoView view = RhinoDocument.Views.Find("Perspective", false);
        if (view == null)
          break;

        string fileName = string.Format("{0}\\{1}.png", _folder, imageNumber);
        imageNumber++;

        Bitmap image = view.CaptureToBitmap();
        if (image == null)
          continue;

        image.Save(fileName);
        image.Dispose();
        image = null;
      }
    }
    catch(Exception ex)
    {
      // Ehm, exception, best swallow it here lest it totally crashes everything.
    }
    finally
    {
      // Always make sure that _running is switched off.
      _running = false;
    }
  }

  private bool MoveToNextPermutation(ref int index, List<Grasshopper.Kernel.Special.GH_NumberSlider> sliders)
  {
    if (index >= sliders.Count)
      return false;

    Grasshopper.Kernel.Special.GH_NumberSlider slider = sliders[index];
    if (slider.TickValue < slider.TickCount)
    {
      // Increment the slider.
      slider.TickValue++;
      return true;
    }
    else
    {
      // The current slider is already at the maximum value. Reset it back to zero.
      slider.TickValue = 0;

      // Move on to the next slider.
      index++;

      // If we've run out of sliders to modify, we're done permutatin'
      if (index >= sliders.Count)
        return false;

      return MoveToNextPermutation(ref index, sliders);
    }
  }
# ---------- end c_script ----------
move_3 = Move(Geometry=join_3.Breps, Motion=Z)  # -> Geometry, Transform

brep = Brep(<brep referenced from the Rhino model>)
bbox_3 = BoundingBox(Content=brep, Plane=PlaneXY(0, 0, 0))  # -> Box, Box_2
debrep_3 = DeconstructBrep(Brep=bbox_3.Box)  # -> Faces, Edges, Vertices
item_8 = ListItem(List=debrep_3.Vertices, Index=Slider(6, range=0..20), Wrap=True)

join_4 = BrepJoin(Breps=[pipe, move_3.Geometry])  # -> Breps, Closed
