# Grasshopper definition hindhi_a.gh (Grasshopper 1.0.4)

背もたれ上端高さ = Slider(2, range=2..5, expression="x*100")
座面高さ = Slider(5, range=3..5, expression="x*100")
座面厚み = Slider(3, range=1..3, expression="x*50")
基本幅 = Slider(4, range=4..10, expression="x*100")
基本幅_2 = Slider(4, range=4..6, expression="x*100")
基本幅_3 = Slider(1, range=1..5, expression="x*0.2")
subtraction = Subtraction(A=座面高さ, B=座面厚み)
rectangle = Rectangle(Plane=PlaneXY(0, 0, 0), XSize=基本幅, YSize=基本幅_2, Radius=0)  # -> Rectangle, Length
geo = Geometry(rectangle.Rectangle)
Z = UnitZ(Factor=subtraction)
move = Move(Geometry=geo, Motion=Z)  # -> Geometry, Transform
debrep = DeconstructBrep(Brep=geo)  # -> Faces, Edges, Vertices
debrep_2 = DeconstructBrep(Brep=move.Geometry)  # -> Faces, Edges, Vertices
dom = ConstructDomain(DomainStart="-15", DomainEnd="15")
join = JoinCurves(Curves=debrep_2.Edges, Preserve=False)
rectangle_2 = Rectangle(Plane=PlaneXY(0, 0, 0), XSize=dom, YSize=dom, Radius=0)  # -> Rectangle, Length
ln = Line(StartPoint=debrep.Vertices, EndPoint=debrep_2.Vertices)
geo_2 = Geometry(rectangle_2.Rectangle)
offset = OffsetCurve(Curve=join, Distance="15", Plane=PlaneXY(0, 0, 0), Corners=1)
orient = Orient(Geometry=geo_2, Source=PlaneXY(0, 0, 0), Target=debrep.Vertices)  # -> Geometry, Transform
boundary = BoundarySurfaces(Edges=offset, UseTasks=True)
Z_2 = UnitZ(Factor=座面厚み)
graft = GraftTree(Tree=ln, IncludeEmptyLists=True, IncludeNullItems=True)
graft_2 = GraftTree(Tree=orient.Geometry, IncludeEmptyLists=True, IncludeNullItems=True)
addition = Addition(A=subtraction, B=座面厚み)
swp1 = Sweep1(Rail=graft, Sections=graft_2, Miter=1)
Z_3 = UnitZ(Factor=addition)
move_2 = Move(Geometry=debrep.Vertices, Motion=Z_3)  # -> Geometry, Transform
item = ListItem(List=move_2.Geometry, Index=0, Wrap=True)  # -> Item, Item1, Item2, Item3
Z_4 = UnitZ(Factor=1)
pt = Point([item.Item2, item.Item3])
pt_2 = Point(item.Item3)
orient_2 = Orient(Geometry=rectangle_2.Rectangle, Source=PlaneXY(0, 0, 0), Target=pt)  # -> Geometry, Transform
line = LineSDL(Start=pt, Direction=Z_4, Length=背もたれ上端高さ)
number_slider = Slider(100, range=0..100)
graft_3 = GraftTree(Tree=orient_2.Geometry, IncludeEmptyLists=True, IncludeNullItems=True)
graft_4 = GraftTree(Tree=line, IncludeEmptyLists=True, IncludeNullItems=True)
swp1_2 = Sweep1(Rail=graft_4, Sections=graft_3, Miter=1)
end = EndPoints(Curve=graft_4)  # -> Start, End
Z_5 = UnitZ(Factor=number_slider)
len = Length(Curve=graft_4)
ln_2 = Line(StartPoint=item.Item, EndPoint=item.Item3)
pt_3 = Point(item.Item)
bang = ExplodeTree(Data=end.End)  # -> Branch0, Branch1
cap = CapHoles(Brep=swp1_2)
line_2 = LineSDL(Start=pt_3, Direction=Z_5, Length=number_slider)
move_3 = Move(Geometry=ln_2, Motion=Z_5)  # -> Geometry, Transform
pt_4 = Point(bang.Branch0)
pt_5 = Point(bang.Branch1)
join_2 = JoinCurves(Curves=[line_2, move_3.Geometry], Preserve=False)
ln_3 = Line(StartPoint=pt_4, EndPoint=pt_5)
len_2 = Length(Curve=ln_3)
mid = TK_MidPoint(C=ln_3)  # -> P
# ---------- mid: Python ----------
import rhinoscriptsyntax as rs

if C!=None:
    P=rs.CurveMidPoint(C)
else:
    P=None
# ---------- end mid ----------
orient_3 = Orient(Geometry=rectangle_2.Rectangle, Source=PlaneXY(0, 0, 0), Target=pt_3)  # -> Geometry, Transform
division = Division(A=len_2, B=2)
multiplication = Multiplication(A=len, B=基本幅_3)
xz = XZPlane(Origin=mid)
subtraction_2 = Subtraction(A=division, B="15")
swp1_3 = Sweep1(Rail=join_2, Sections=orient_3.Geometry, Miter=1)
multiplication_2 = Multiplication(A=subtraction_2, B=-1)
yz = YZPlane(Origin=mid)
dom_2 = ConstructDomain(DomainStart=multiplication_2, DomainEnd=subtraction_2)
mirror = Mirror(Geometry=swp1_3, Plane=yz)  # -> Geometry, Transform
multiplication_3 = Multiplication(A=multiplication, B=-1)
rectangle_3 = Rectangle(Plane=xz, XSize=dom_2, YSize=multiplication_3, Radius=0)  # -> Rectangle, Length
boundary_2 = BoundarySurfaces(Edges=rectangle_3.Rectangle)
Y = UnitY(Factor=dom)
extr = Extrude(Base=boundary_2, Direction=Y)
Y_2 = UnitY(Factor="-15")
cap_2 = CapHoles(Brep=swp1)
move_4 = Move(Geometry=extr, Motion=Y_2)  # -> Geometry, Transform
extr_2 = Extrude(Base=boundary, Direction=Z_2)
brep = Brep(cap)
brep_2 = Brep([mirror.Geometry, swp1_3])
brep_3 = Brep([cap_2, extr_2, brep, move_4.Geometry, brep_2])
