# Grasshopper definition hindhi_b.gh (Grasshopper 1.0.4)
# plug-ins: GH_CPython

背もたれ丸角半径 = Slider(3, range=1..3, expression="x*30")
肘掛け巻サイズ = Slider(12, range=9..12)
背もたれ高さ = Slider(5, range=3..5, expression="x*50")
座面高 = Slider(5, range=3..5, expression="x*100")
座面厚 = Slider(4, range=1..4, expression="x*50")
基本幅 = Slider(2, range=2..5, expression="x*200")
rectangle = Rectangle(Plane=PlaneXY(0, 0, 0), XSize=基本幅, YSize="500", Radius=0)  # -> Rectangle, Length
subtraction = Subtraction(A=座面高, B=座面厚)
offset = Offset(Curve=rectangle.Rectangle, Distance="35", Plane=PlaneXY(0, 0, 0), Corners=1)
Z = UnitZ(Factor=subtraction)
crv = Curve(offset)
move = Move(Geometry=crv, Motion=Z)  # -> Geometry, Transform
boundary = BoundarySurfaces(Edges=move.Geometry)
Z_2 = UnitZ(Factor=座面厚)
extr = Extrude(Base=boundary, Direction=Z_2)
box = Box(extr)
move_2 = Move(Geometry=rectangle.Rectangle, Motion=Z)  # -> Geometry, Transform
range = Range(Domain=Domain(0, 1), Steps=10)
crv_2 = Curve(rectangle.Rectangle)
debrep = DeconstructBrep(Brep=move_2.Geometry)  # -> Faces, Edges, Vertices
debrep_2 = DeconstructBrep(Brep=crv_2)  # -> Faces, Edges, Vertices
graph = GraphMapper(range, x0=0, x1=1, y0=0, y1=1, container_name="Sine", Equation_px=[0, 0.5014856458], Equation_py=[0, 0.06889629364])
debrep_3 = DeconstructBrep(Brep=box)  # -> Faces, Edges, Vertices
ln = Line(StartPoint=debrep.Vertices, EndPoint=debrep_2.Vertices)
series = Series(Start=0, Step=1, Count=肘掛け巻サイズ)
fib = Fibonacci(SeedA=0, SeedB=1, Number=肘掛け巻サイズ)
dup = DuplicateData(Data=graph, Number="4", Order=True)
item = ListItem(List=debrep_3.Edges, Index="7", Wrap=True)
divide = DivideCurve(Curve=ln, Count=10, Kinks=False)  # -> Points, Tangents, Parameters
rev = ReverseList(List=fib)
partition = PartitionList(List=dup, Size=11)
end = EndPoints(Curve=item)  # -> Start, End
Z_3 = UnitZ(Factor=1)
shift = ShiftList(List=rev, Shift="2", Wrap=True)
pdecon = Deconstruct(Point=divide.Points)  # -> XComponent, YComponent, ZComponent
debrep_4 = DeconstructBrep(Brep=rectangle.Rectangle)  # -> Faces, Edges, Vertices
line = LineSDL(Start=end.Start, Direction=Z_3, Length="150")
lng = ListLength(List=shift)
multiplication = Multiplication(A=pdecon.XComponent, B=partition)
multiplication_2 = Multiplication(A=pdecon.XComponent, B=partition)
item_2 = ListItem(List=debrep_4.Vertices, Index=0, Wrap=True)  # -> Item, Item1, Item2, Item3
end_2 = EndPoints(Curve=line)  # -> Start, End
subtraction_2 = Subtraction(A=lng, B=3)
multiplication_3 = Multiplication(A=基本幅, B=0.5)
pt = ConstructPoint(XCoordinate=multiplication, YCoordinate=multiplication_2, ZCoordinate=pdecon.ZComponent)
pt_2 = Point(item_2.Item2)
pt_3 = Point(item_2.Item3)
pt_4 = PointCylindrical(BasePlane=PlaneXY(0, 0, 0), Angle=series, Radius=shift, Elevation=0)
yz = YZPlane(Origin=end_2.End)
dom = ConstructDomain(DomainStart=0, DomainEnd=subtraction_2)
pt_5 = Point([end_2.Start, end_2.End])
ln_2 = Line(StartPoint=pt_2, EndPoint=pt_3)
multiplication_4 = Multiplication(A=multiplication_3, B=-1)
intcrv = Interpolate(Vertices=pt, Degree=3, Periodic=False, KnotStyle=1)  # -> Curve, Length, Domain
xz = XZPlane(Origin=yz)
item_3 = ListItem(List=pt_4, Index=0, Wrap=True)
subset = SubList(List=pt_4, Domain=dom, Wrap=True)  # -> List, Index
mid = TK_MidPoint(C=ln_2)  # -> P
# ---------- mid: Python ----------
import rhinoscriptsyntax as rs

if C!=None:
    P=rs.CurveMidPoint(C)
else:
    P=None
# ---------- end mid ----------
dom_2 = ConstructDomain(DomainStart=multiplication_4, DomainEnd=multiplication_3)
multiplication_5 = Multiplication(A=背もたれ高さ, B=2)
reb = RebuildCurve(Curve=intcrv.Curve, Count=5, Tangents=False)
item_4 = ListItem(List=debrep_2.Vertices, Index=0, Wrap=True)  # -> Item, Item1, Item2, Item3
intcrv_2 = Interpolate(Vertices=subset.List, Degree=3, Periodic=False, KnotStyle=1)  # -> Curve, Length, Domain
xz_2 = XZPlane(Origin=mid)
bang = ExplodeTree(Data=reb)  # -> _0000, _0001, _0002, _0003
orient = Orient(Geometry=intcrv_2.Curve, Source=item_3, Target=xz)  # -> Geometry, Transform
pt_6 = Point(Point(0, 0, 0))
pt_7 = Point([item_4.Item1, item_4.Item2, item_4.Item3])
rectangle_2 = Rectangle(Plane=xz_2, XSize=dom_2, YSize=multiplication_5, Radius=背もたれ丸角半径)  # -> Rectangle, Length
Z_4 = UnitZ(Factor=座面高)
eval = EvaluateCurve(Curve=orient.Geometry, Parameter=0)  # -> Point, Tangent, Angle
pipe = Pipe(Curve=bang._0002, Radius="15", Caps=1)
vec2pt = Vector2Pt(PointA=pt_6, PointB=pt_7, Unitize=False)  # -> Vector, Length
move_3 = Move(Geometry=rectangle_2.Rectangle, Motion=Z_4)  # -> Geometry, Transform
intcrv_t = InterpolateT(Vertices=pt_5, Degree=3, TangentStart=Vector(0, 0, 0), TangentEnd=eval.Tangent, KnotStyle=1)  # -> Curve, Length, Domain
Y = UnitY(Factor=expr("x*-1", "100"))
move_4 = Move(Geometry=pipe, Motion=vec2pt.Vector)  # -> Geometry, Transform
boundary_2 = BoundarySurfaces(Edges=move_3.Geometry)
join = JoinCurves(Curves=[orient.Geometry, intcrv_t.Curve], Preserve=False)
item_5 = ListItem(List=move_4.Geometry, Index=0, Wrap=True)  # -> Item, Item1, Item2
num = Number(expr("rad(x)", "90"))
num_2 = Number(expr("rad(x)", "180"))
num_3 = Number(expr("rad(x)", "270"))
extr_2 = Extrude(Base=boundary_2, Direction=Y)
swp1 = Sweep1(Rail=item, Sections=join, Miter=1)
rotate = Rotate(Geometry=item_5.Item, Angle=num, Plane=item_4.Item1)  # -> Geometry, Transform
rotate_2 = Rotate(Geometry=item_5.Item1, Angle=num_2, Plane=item_4.Item2)  # -> Geometry, Transform
rotate_3 = Rotate(Geometry=item_5.Item2, Angle=num_3, Plane=item_4.Item3)  # -> Geometry, Transform
geo = Geometry(pipe)
offset_2 = Offset(Surface=swp1, Distance="10", Retrim=True)
division = Division(A=基本幅, B=2)
loft = Loft(
    Curves=[swp1, offset_2],
    Options={Adjust=False, Closed=False, LoftEnds=0, LoftSimp=0, LoftType=0, Rebuild=10, Refit=0.01})
pt_8 = ConstructPoint(XCoordinate=division, YCoordinate=0, ZCoordinate=0)
yz_2 = YZPlane(Origin=pt_8)
join_2 = BrepJoin(Breps=[swp1, loft, offset_2])  # -> Breps, Closed
mirror = Mirror(Geometry=join_2.Breps, Plane=yz_2)  # -> Geometry, Transform
brep = Brep([geo, rotate.Geometry, rotate_2.Geometry, rotate_3.Geometry, extr_2, box, join_2.Breps, mirror.Geometry])
brep_2 = Brep()

panel = Panel("""基本幅
座面高
座面厚
背もたれ高さ
背もたれ丸角半径
肘掛け巻サイズ""")
panel_2 = Panel("動かしたいスライダー名を指定して、Saveボタンをおすと上で指定したディレクトリにmatファイルが連番で保存されます。")
c_script = CSharpScript(sliderNames=panel, save=Button())  # -> out; inputs sliderNames: list of String, save: Boolean
# ---------- c_script: C# ----------
    _sliderNames = sliderNames;



    if (!save)
      return;

    if (_running)
      return;


    _run = true;


    GrasshopperDocument.SolutionEnd += OnSolutionEnd;
# ---------- c_script: C# additional code ----------
  private bool _run = false;
  private bool _running = false;
  private List<string> _sliderNames;

  private void OnSolutionEnd(object sender, GH_SolutionEventArgs e)
  {
    // Unregister the event, we don't want to get called again.
    e.Document.SolutionEnd -= OnSolutionEnd;

    // If we're not supposed to run, abort now.
    if (!_run)
      return;

    // If we're already running, abort now.
    if (_running)
      return;
    
    // Reset run and running states.
    _run = false;
    _running = true;

    try
    {
      // Find all sliders.
      List<Grasshopper.Kernel.Special.GH_NumberSlider> sliders = new List<Grasshopper.Kernel.Special.GH_NumberSlider>();

      foreach (IGH_DocumentObject docObject in GrasshopperDocument.Objects)
      {
        Grasshopper.Kernel.Special.GH_NumberSlider slider = docObject as Grasshopper.Kernel.Special.GH_NumberSlider;
        if (slider == null)
          continue;
        sliders.Add(slider);
      }
      if (sliders.Count == 0)
      {
        System.Windows.Forms.MessageBox.Show("No sliders could be found", "<harsh buzzing sound>", MessageBoxButtons.OK);
        return;
      }


      List<bool> contains = new List<bool>();
      List<Grasshopper.Kernel.Special.GH_NumberSlider> filteredSliders = new List<Grasshopper.Kernel.Special.GH_NumberSlider>();
      foreach(Grasshopper.Kernel.Special.GH_NumberSlider slider in sliders){
        if(_sliderNames.Contains(slider.NickName)){
          filteredSliders.Add(slider);
        }

      }
      //A = filteredSliders.Count;

      // Set all sliders back to zero.
      //GH_Document.EnableSolutions = false;
      foreach (Grasshopper.Kernel.Special.GH_NumberSlider slider in filteredSliders)
        slider.TickValue = 0;

      while (true)
      {
        int idx = 0;
        if (!MoveToNextPermutation(ref idx, filteredSliders))
          break;

        // We've just got a new valid permutation. Solve the new solution.
        e.Document.NewSolution(false);
        Rhino.RhinoDoc.ActiveDoc.Views.Redraw();

      }

    }
    catch(Exception ex)
    {
      // Ehm, exception, best swallow it here lest it totally crashes everything.
    }
    finally
    {
      // Always make sure that _running is switched off.
      _running = false;
    }


    
  }

  private bool MoveToNextPermutation(ref int index, List<Grasshopper.Kernel.Special.GH_NumberSlider> filteredSliders)
  {
    if (index >= filteredSliders.Count)
      return false;

    Grasshopper.Kernel.Special.GH_NumberSlider slider = filteredSliders[index];
    if (slider.TickValue < slider.TickCount)
    {
      // Increment the slider.
      slider.TickValue++;
      return true;
    }
    else
    {
      // The current slider is already at the maximum value. Reset it back to zero.
      slider.TickValue = 0;

      // Move on to the next slider.
      index++;

      // If we've run out of sliders to modify, we're done permutatin'
      if (index >= filteredSliders.Count)
        return false;

      return MoveToNextPermutation(ref index, filteredSliders);
    }
  }
# ---------- end c_script ----------

panel_3 = Panel("C:/Users/RFA4/Desktop/G_Chair_mat/train_sample/hindhi_b")

# ----
# Path: Matファイルを保存するディレクトリ
# Size:バウンディングボックスの横・縦・高さの大きさ
# Resolution：分割数（ShapeNetsの分割数が30なので、30がいいと思います）
# Save: TrueでMatが保存されます。
# File: ファイルの名前です
# Reset: 連番のリセット
# "F:/odrive/Google Drive/JH/Projects/[096] Deep Learning Chair/02. projects/saved_data"
geo_2 = Geometry(flatten(brep_2))
number_slider = Slider(1200, range=0..1500)
number_slider_2 = Slider(30, range=0..100)
cluster = Cluster(
    geometry=geo_2,
    path=panel_3,
    size=number_slider,
    resolution=number_slider_2,
    save=Toggle(False),
    file="chair_hindhi_b",
    reset=Button())

int = Integer(Slider(52, range=0..100))

range_2 = Range(Domain=number_slider, Steps=expr("x-1", simplify(number_slider_2)))
pt_9 = ConstructPoint(XCoordinate=range_2, YCoordinate=0, ZCoordinate=0)
gh_cpython = GH_CPython(path=panel_3, file="chair_hindhi_b", num=int, load=Button())  # -> output, a; inputs path: list, file: list, num: list, load: list
#   port path: [required] - [type = int] - [default = None] Descripe your input here * bullet point. * bullet point
#   port output: indicate your output description here. refers to a new line.
# ---------- gh_cpython: Python ----------
import scipy.io
import Grasshopper as gh

numformat =  str('{:010d}'.format(num))
mat = scipy.io.loadmat(path + "/" + file + "-" + numformat)

#output_ = numformat



output_ = mat["instance"].tolist()

a = mat["instance"]
# ---------- end gh_cpython ----------
graft = GraftTree(Tree=pt_9, IncludeEmptyLists=True, IncludeNullItems=True)
Y_2 = UnitY(Factor=range_2)
panel_4 = Panel("保存したMatを確認するためのデフィニションです。")
move_5 = Move(Geometry=graft, Motion=Y_2)  # -> Geometry, Transform
c_script_2 = CSharpScript(x=gh_cpython.output, n=number_slider_2)  # -> out, A; inputs x: list of Int32, n: Int32
# ---------- c_script_2: C# ----------
    DataTree<int> tree = new DataTree<int>();

    int count = 0;
    for(int i = 0; i < n; i++){
      for(int s = 0; s < n; s++){
        for(int t = 0; t < n; t++){
          GH_Path path = new GH_Path(i, s,t);
          tree.Add(x[count], path);

          count++;
        }
      }
    }

    A = tree;
# ---------- end c_script_2 ----------
graft_2 = GraftTree(Tree=move_5.Geometry, IncludeEmptyLists=True, IncludeNullItems=True)
Z_5 = UnitZ(Factor=range_2)
item_6 = ListItem(List=range_2, Index=1, Wrap=True)
move_6 = Move(Geometry=graft_2, Motion=Z_5)  # -> simplify(Geometry), Transform
division_2 = Division(A=item_6, B=2)
graft_3 = GraftTree(Tree=move_6.Geometry, IncludeEmptyLists=True, IncludeNullItems=True)  # -> simplify(Tree)
cull = CullPattern(List=graft_3, CullPattern=c_script_2.A)
box_2 = CenterBox(Base=cull, X=division_2, Y=division_2, Z=division_2)

preview = CustomPreview(Geometry=box_2, Material=ColourSwatch(SwatchColor=RGB(102, 168, 255)))

# ==== cluster Cluster
resolution = ClusterInput()
size = ClusterInput()
geometry = ClusterInput()
int = Integer(resolution)

num = Number(size)
geo = Geometry(flatten(geometry))
range = Range(Domain=num, Steps=expr("x-1", simplify(int)))
bbox = BoundingBox(Content=geo, Plane=PlaneXY(0, 0, 0), UnionBox=True)  # -> Box, Box_2
area = Area(Geometry=bbox.Box)  # -> Area, Centroid
pt = ConstructPoint(XCoordinate=range, YCoordinate=0, ZCoordinate=0)  # -> simplify(graft(Point))
pt_2 = ConstructPoint(XCoordinate=num, YCoordinate=num, ZCoordinate=0)
pt_3 = ConstructPoint(XCoordinate=num, YCoordinate=num, ZCoordinate=num)
pt_4 = ConstructPoint(XCoordinate=0, YCoordinate=0, ZCoordinate=0)
pdecon = Deconstruct(Point=area.Centroid)  # -> XComponent, YComponent, ZComponent
division = Division(A=pt_2, B=2)
box = Box2Pt(PointA=pt_4, PointB=pt_3, Plane=PlaneXY(0, 0, 0))
Z = UnitZ(Factor=range)
pt_5 = ConstructPoint(XCoordinate=pdecon.XComponent, YCoordinate=pdecon.YComponent, ZCoordinate=0)
item = ListItem(List=range, Index=1, Wrap=True)
orient = Orient(Geometry=geo, Source=pt_5, Target=division)  # -> Geometry, Transform
division_2 = Division(A=item, B=2.01)
mesh = Mesh(orient.Geometry)
mjoin = MeshJoin(Meshes=mesh)

Y = UnitY(Factor=range)
move = Move(Geometry=pt, Motion=Y)  # -> graft(Geometry), Transform

move_2 = Move(Geometry=move.Geometry, Motion=Z)  # -> Geometry, Transform
flatten = FlattenTree(Tree=move_2.Geometry, Path="{0}")
pull = PullPoint(Point=flatten, Geometry=mjoin, ClosestOnly=True)  # -> ClosestPoint, Distance
smaller = SmallerThan(FirstNumber=pull.Distance, SecondNumber=division_2)  # -> SmallerThan, OrEqualTo
cull = CullPattern(List=flatten, CullPattern=smaller.SmallerThan)

meshcp = MeshClosestPoint(Point=flatten, Mesh=mjoin)  # -> Point, Index, Parameter
vec2pt = Vector2Pt(PointA=flatten, PointB=meshcp.Point, Unitize=False)  # -> Vector, Length
meval = MeshEval(Mesh=mjoin, Parameter=meshcp.Parameter)  # -> Point, Normal, Colour
unit = UnitVector(Vector=vec2pt.Vector)
unit_2 = UnitVector(Vector=meval.Normal)
dprod = DotProduct(VectorA=unit_2, VectorB=unit, Unitize=False)
larger = LargerThan(FirstNumber=dprod, SecondNumber=Slider(0.1, range=0..1))  # -> LargerThan, OrEqualTo

reset = ClusterInput()
file = ClusterInput()
c_script = CSharpScript(g=geo, reset=reset)  # -> out, A; inputs g: tree, reset: Boolean
# ---------- c_script: C# ----------
    count++;

    if(reset){
      count = 0;
    }

    A = count.ToString("D10");
# ---------- c_script: C# additional code ----------
  int count = 0;
# ---------- end c_script ----------
txt = Text(file)
concat = Concatenate(FragmentA=txt, FragmentC="-", FragmentB=c_script.A, FragmentD=".mat")

or = GateOr(A=smaller.SmallerThan, B=larger.OrEqualTo)

int_2 = Integer(int)
num_2 = Number(int)
path = ClusterInput()
save = ClusterInput()
int_3 = Integer(or)
gh_cpython = GH_CPython(path=path, file=concat, data=int_3, n=num_2, save=save)  # -> output; inputs path: list, file: list, data: list, n: list, save: list
#   port output: indicate your output description here. refers to a new line.
# ---------- gh_cpython: Python ----------
import numpy as np
import scipy.io

arr = np.empty((0,n,n), int)

count = 0
for i in range(n):
    arrT = np.empty((0,n), int)
    for t in range(n):
        arrS = np.empty((0), int)
        for s in range(n):
            arrS = np.append(arrS, np.array( data[count] ))
            count += 1
        arrT = np.append(arrT,np.array([arrS]), axis=0)
    arr = np.append(arr, np.array([arrT]), axis=0)

output_ = arr

if(save):
    scipy.io.savemat(path + "/" + file, {'instance':arr}, True, '5', False, True)
# ---------- end gh_cpython ----------

cull_2 = CullPattern(List=flatten, CullPattern=or)
output = ClusterOutput(cull_2)
