# Grasshopper definition japan_integrated.gh (Grasshopper 0.9.76)

背もたれ上端高さ = Slider(8, range=5..10, expression="x*100")
背もたれ高さ = Slider(-3, range=-5..-1, expression="x*100")
背もたれ厚さ = Slider(-3, range=-5..-1, expression="x*10")
手すり位置 = Slider(1, range=0.5..1.5)
基本奥行 = Slider(5, range=3..10, expression="x*100")
座面高さ = Slider(4, range=3..5, expression="x*100")
座面厚さ = Slider(-3, range=-5..-1, expression="x*10")
パイプ径 = Slider(4, range=2..6, expression="x*5")
基本幅 = Slider(5, range=3..10, expression="x*100")
rectangle = Rectangle(Plane=PlaneXY(0, 0, 0), XSize=基本幅, YSize=基本奥行, Radius=0)  # -> Rectangle, Length
debrep = DeconstructBrep(Brep=rectangle.Rectangle)  # -> Faces, Edges, Vertices
graft = GraftTree(Tree=debrep.Edges, IncludeEmptyLists=True, IncludeNullItems=True)
graft_2 = GraftTree(Tree=debrep.Vertices, IncludeEmptyLists=True, IncludeNullItems=True)
bang = ExplodeTree(Data=graft_2)  # -> Branch0, Branch1, Branch2, Branch3
bang_2 = ExplodeTree(Data=graft)  # -> Branch0, Branch1, Branch2, Branch3
flip = FlipCurve(Curve=bang_2.Branch3)  # -> Curve, Flag
eval = EvaluateCurve(Curve=reparameterize(flip.Curve), Parameter=手すり位置)  # -> Point, Tangent, Angle
eval_2 = EvaluateCurve(Curve=reparameterize(bang_2.Branch1), Parameter=手すり位置)  # -> Point, Tangent, Angle
pt = Point([bang.Branch1, bang.Branch2])
pt_2 = Point([bang.Branch1, bang.Branch2])
pt_3 = Point(flatten([eval_2.Point, pt, eval.Point]))
addition = Addition(A=座面高さ, B="200")
division = Division(A="200", B=-3)
intcrv = Interpolate(Vertices=pt_3, Degree=3, Periodic=False, KnotStyle=1)  # -> Curve, Length, Domain
line = LineSDL(Start=[eval_2.Point, eval.Point], Direction=Vector(0, 0, -1), Length="200")
Z = UnitZ(Factor=addition)
Z_2 = UnitZ(Factor=division)
Z_3 = UnitZ(Factor=座面高さ)
crv = Curve(reparameterize(intcrv.Curve))
move = Move(Geometry=intcrv.Curve, Motion=Z_2)  # -> Geometry, Transform
move_2 = Move(Geometry=rectangle.Rectangle, Motion=Z_3)  # -> Geometry, Transform
crv_cp = CurveClosestPoint(Point=pt_2, Curve=crv)  # -> Point, flatten(Parameter), Distance
move_3 = Move(Geometry=[intcrv.Curve, line, move.Geometry], Motion=Z)  # -> Geometry, Transform
shatter = Shatter(Curve=crv, Parameters=crv_cp.Parameter)  # -> graft(Segments)
boundary = BoundarySurfaces(Edges=move_2.Geometry)
Z_4 = UnitZ(Factor=座面厚さ)
pt_4 = Point(flatten([bang.Branch0, bang.Branch3]))
pt_5 = Point(flatten([bang.Branch1, bang.Branch2]))
bang_3 = ExplodeTree(Data=shatter)  # -> Branch0, Branch1, Branch2
division_2 = Division(A="200", B=-3)
cir = Circle(Plane=pt_4, Radius=パイプ径)
Z_5 = UnitZ(Factor=座面高さ)
cir_2 = Circle(Plane=pt_5, Radius=パイプ径)
Z_6 = UnitZ(Factor=背もたれ上端高さ)
crv_2 = Curve(bang_3.Branch1)
Z_7 = UnitZ(Factor=division_2)
Z_8 = UnitZ(Factor=背もたれ上端高さ)
extr = Extrude(Base=cir, Direction=Z_5)
extr_2 = Extrude(Base=cir_2, Direction=Z_6)
move_4 = Move(Geometry=crv_2, Motion=Z_7)  # -> Geometry, Transform
move_5 = Move(Geometry=[crv_2, move_4.Geometry], Motion=Z_8)  # -> Geometry, Transform
pipe = Pipe(Curve=[move_3.Geometry, move_5.Geometry], Radius=パイプ径, Caps=2)
cap = CapHoles(Brep=extr)
cap_2 = CapHoles(Brep=extr_2)
extr_3 = Extrude(Base=boundary, Direction=Z_4)
