# Grasshopper definition russia_a.gh (Grasshopper 1.0.4)
# plug-ins: GH_CPython

背もたれ上端高さ = Slider(2, range=2..5, expression="x*100")
座面高さ = Slider(3, range=3..5, expression="x*100")
座面厚み = Slider(1, range=1..3, expression="x*50")
基本幅 = Slider(4, range=4..10, expression="x*100")
基本奥行き = Slider(4, range=4..6, expression="x*100")
背もたれ高さ = Slider(1, range=1..5, expression="x*0.2")
subtraction = Subtraction(A=座面高さ, B=座面厚み)
rectangle = Rectangle(Plane=PlaneXY(0, 0, 0), XSize=基本幅, YSize=基本奥行き, Radius=0)  # -> Rectangle, Length
geo = Geometry(rectangle.Rectangle)
Z = UnitZ(Factor=subtraction)
move = Move(Geometry=geo, Motion=Z)  # -> Geometry, Transform
debrep = DeconstructBrep(Brep=geo)  # -> Faces, Edges, Vertices
debrep_2 = DeconstructBrep(Brep=move.Geometry)  # -> Faces, Edges, Vertices
dom = ConstructDomain(DomainStart="-15", DomainEnd="15")
join = JoinCurves(Curves=debrep_2.Edges, Preserve=False)
rectangle_2 = Rectangle(Plane=PlaneXY(0, 0, 0), XSize=dom, YSize=dom, Radius=0)  # -> Rectangle, Length
ln = Line(StartPoint=debrep.Vertices, EndPoint=debrep_2.Vertices)
geo_2 = Geometry(rectangle_2.Rectangle)
offset = OffsetCurve(Curve=join, Distance="15", Plane=PlaneXY(0, 0, 0), Corners=1)
orient = Orient(Geometry=geo_2, Source=PlaneXY(0, 0, 0), Target=debrep.Vertices)  # -> Geometry, Transform
boundary = BoundarySurfaces(Edges=offset, UseTasks=True)
Z_2 = UnitZ(Factor=座面厚み)
graft = GraftTree(Tree=ln, IncludeEmptyLists=True, IncludeNullItems=True)
graft_2 = GraftTree(Tree=orient.Geometry, IncludeEmptyLists=True, IncludeNullItems=True)
addition = Addition(A=subtraction, B=座面厚み)
swp1 = Sweep1(Rail=graft, Sections=graft_2, Miter=1)
Z_3 = UnitZ(Factor=addition)
move_2 = Move(Geometry=debrep.Vertices, Motion=Z_3)  # -> Geometry, Transform
item = ListItem(List=move_2.Geometry, Index=0, Wrap=True)  # -> Item, Item1, Item2, Item3
Z_4 = UnitZ(Factor=1)
pt = Point([item.Item2, item.Item3])
pt_2 = Point(item.Item3)
orient_2 = Orient(Geometry=rectangle_2.Rectangle, Source=PlaneXY(0, 0, 0), Target=pt)  # -> Geometry, Transform
line = LineSDL(Start=pt, Direction=Z_4, Length=背もたれ上端高さ)
number_slider = Slider(100, range=0..100)
graft_3 = GraftTree(Tree=orient_2.Geometry, IncludeEmptyLists=True, IncludeNullItems=True)
graft_4 = GraftTree(Tree=line, IncludeEmptyLists=True, IncludeNullItems=True)
swp1_2 = Sweep1(Rail=graft_4, Sections=graft_3, Miter=1)
end = EndPoints(Curve=graft_4)  # -> Start, End
Z_5 = UnitZ(Factor=number_slider)
len = Length(Curve=graft_4)
ln_2 = Line(StartPoint=item.Item, EndPoint=item.Item3)
pt_3 = Point(item.Item)
bang = ExplodeTree(Data=end.End)  # -> Branch0, Branch1
cap = CapHoles(Brep=swp1_2)
line_2 = LineSDL(Start=pt_3, Direction=Z_5, Length=number_slider)
move_3 = Move(Geometry=ln_2, Motion=Z_5)  # -> Geometry, Transform
pt_4 = Point(bang.Branch0)
pt_5 = Point(bang.Branch1)
join_2 = JoinCurves(Curves=[line_2, move_3.Geometry], Preserve=False)
ln_3 = Line(StartPoint=pt_4, EndPoint=pt_5)
len_2 = Length(Curve=ln_3)
mid = TK_MidPoint(C=ln_3)  # -> P
# ---------- mid: Python ----------
import rhinoscriptsyntax as rs

if C!=None:
    P=rs.CurveMidPoint(C)
else:
    P=None
# ---------- end mid ----------
orient_3 = Orient(Geometry=rectangle_2.Rectangle, Source=PlaneXY(0, 0, 0), Target=pt_3)  # -> Geometry, Transform
division = Division(A=len_2, B=2)
multiplication = Multiplication(A=len, B=背もたれ高さ)
xz = XZPlane(Origin=mid)
subtraction_2 = Subtraction(A=division, B="15")
swp1_3 = Sweep1(Rail=join_2, Sections=orient_3.Geometry, Miter=1)
multiplication_2 = Multiplication(A=subtraction_2, B=-1)
yz = YZPlane(Origin=mid)
dom_2 = ConstructDomain(DomainStart=multiplication_2, DomainEnd=subtraction_2)
mirror = Mirror(Geometry=swp1_3, Plane=yz)  # -> Geometry, Transform
multiplication_3 = Multiplication(A=multiplication, B=-1)
rectangle_3 = Rectangle(Plane=xz, XSize=dom_2, YSize=multiplication_3, Radius=0)  # -> Rectangle, Length
boundary_2 = BoundarySurfaces(Edges=rectangle_3.Rectangle)
Y = UnitY(Factor=dom)
extr = Extrude(Base=boundary_2, Direction=Y)
Y_2 = UnitY(Factor="-15")
cap_2 = CapHoles(Brep=swp1)
move_4 = Move(Geometry=extr, Motion=Y_2)  # -> Geometry, Transform
extr_2 = Extrude(Base=boundary, Direction=Z_2)
brep = Brep(cap)
brep_2 = Brep([mirror.Geometry, swp1_3])
cap_3 = CapHoles(Brep=brep)
cap_4 = CapHoles(Brep=brep_2)
brep_3 = Brep([cap_2, extr_2, move_4.Geometry, cap_3, cap_4])
brep_4 = Brep(brep_3)
panel = Panel("""基本奥行き
肘掛け高さ""")

panel_2 = Panel("""基本幅
基本奥行き
座面高さ
背もたれ高さ
座面厚み
背もたれ上端高さ""")
panel_3 = Panel("動かしたいスライダー名を指定して、Saveボタンをおすと上で指定したディレクトリにmatファイルが連番で保存されます。")
c_script = CSharpScript(sliderNames=panel_2, save=Button())  # -> out; inputs sliderNames: list of String, save: Boolean
# ---------- c_script: C# ----------
    _sliderNames = sliderNames;



    if (!save)
      return;

    if (_running)
      return;


    _run = true;


    GrasshopperDocument.SolutionEnd += OnSolutionEnd;
# ---------- c_script: C# additional code ----------
  private bool _run = false;
  private bool _running = false;
  private List<string> _sliderNames;

  private void OnSolutionEnd(object sender, GH_SolutionEventArgs e)
  {
    // Unregister the event, we don't want to get called again.
    e.Document.SolutionEnd -= OnSolutionEnd;

    // If we're not supposed to run, abort now.
    if (!_run)
      return;

    // If we're already running, abort now.
    if (_running)
      return;
    
    // Reset run and running states.
    _run = false;
    _running = true;

    try
    {
      // Find all sliders.
      List<Grasshopper.Kernel.Special.GH_NumberSlider> sliders = new List<Grasshopper.Kernel.Special.GH_NumberSlider>();

      foreach (IGH_DocumentObject docObject in GrasshopperDocument.Objects)
      {
        Grasshopper.Kernel.Special.GH_NumberSlider slider = docObject as Grasshopper.Kernel.Special.GH_NumberSlider;
        if (slider == null)
          continue;
        sliders.Add(slider);
      }
      if (sliders.Count == 0)
      {
        System.Windows.Forms.MessageBox.Show("No sliders could be found", "<harsh buzzing sound>", MessageBoxButtons.OK);
        return;
      }


      List<bool> contains = new List<bool>();
      List<Grasshopper.Kernel.Special.GH_NumberSlider> filteredSliders = new List<Grasshopper.Kernel.Special.GH_NumberSlider>();
      foreach(Grasshopper.Kernel.Special.GH_NumberSlider slider in sliders){
        if(_sliderNames.Contains(slider.NickName)){
          filteredSliders.Add(slider);
        }

      }
      //A = filteredSliders.Count;

      // Set all sliders back to zero.
      //GH_Document.EnableSolutions = false;
      foreach (Grasshopper.Kernel.Special.GH_NumberSlider slider in filteredSliders)
        slider.TickValue = 0;

      while (true)
      {
        int idx = 0;
        if (!MoveToNextPermutation(ref idx, filteredSliders))
          break;

        // We've just got a new valid permutation. Solve the new solution.
        e.Document.NewSolution(false);
        Rhino.RhinoDoc.ActiveDoc.Views.Redraw();

      }

    }
    catch(Exception ex)
    {
      // Ehm, exception, best swallow it here lest it totally crashes everything.
    }
    finally
    {
      // Always make sure that _running is switched off.
      _running = false;
    }


    
  }

  private bool MoveToNextPermutation(ref int index, List<Grasshopper.Kernel.Special.GH_NumberSlider> filteredSliders)
  {
    if (index >= filteredSliders.Count)
      return false;

    Grasshopper.Kernel.Special.GH_NumberSlider slider = filteredSliders[index];
    if (slider.TickValue < slider.TickCount)
    {
      // Increment the slider.
      slider.TickValue++;
      return true;
    }
    else
    {
      // The current slider is already at the maximum value. Reset it back to zero.
      slider.TickValue = 0;

      // Move on to the next slider.
      index++;

      // If we've run out of sliders to modify, we're done permutatin'
      if (index >= filteredSliders.Count)
        return false;

      return MoveToNextPermutation(ref index, filteredSliders);
    }
  }
# ---------- end c_script ----------

panel_4 = Panel("C:/Users/RFA4/Desktop/G_Chair_mat/train_sample/russia_a")

# ----
# Path: Matファイルを保存するディレクトリ
# Size:バウンディングボックスの横・縦・高さの大きさ
# Resolution：分割数（ShapeNetsの分割数が30なので、30がいいと思います）
# Save: TrueでMatが保存されます。
# File: ファイルの名前です
# Reset: 連番のリセット
# "F:/odrive/Google Drive/JH/Projects/[096] Deep Learning Chair/02. projects/saved_data"
geo_3 = Geometry(flatten(brep_4))
number_slider_2 = Slider(1200, range=0..1500)
number_slider_3 = Slider(30, range=0..100)
cluster = Cluster(
    geometry=geo_3,
    path=panel_4,
    size=number_slider_2,
    resolution=number_slider_3,
    save=Toggle(False),
    file="chair_russia_a",
    reset=Button())

int = Integer(Slider(16, range=0..100))

range = Range(Domain=number_slider_2, Steps=expr("x-1", simplify(number_slider_3)))
pt_6 = ConstructPoint(XCoordinate=range, YCoordinate=0, ZCoordinate=0)
gh_cpython = GH_CPython(path=panel_4, file="chair_russia_a", num=int, load=Button())  # -> output, a; inputs path: list, file: list, num: list, load: list
#   port path: [required] - [type = int] - [default = None] Descripe your input here * bullet point. * bullet point
#   port output: indicate your output description here. refers to a new line.
# ---------- gh_cpython: Python ----------
import scipy.io
import Grasshopper as gh

numformat =  str('{:010d}'.format(num))
mat = scipy.io.loadmat(path + "/" + file + "-" + numformat)

#output_ = numformat



output_ = mat["instance"].tolist()

a = mat["instance"]
# ---------- end gh_cpython ----------
graft_5 = GraftTree(Tree=pt_6, IncludeEmptyLists=True, IncludeNullItems=True)
Y_3 = UnitY(Factor=range)
panel_5 = Panel("保存したMatを確認するためのデフィニションです。")
move_5 = Move(Geometry=graft_5, Motion=Y_3)  # -> Geometry, Transform
c_script_2 = CSharpScript(x=gh_cpython.output, n=number_slider_3)  # -> out, A; inputs x: list of Int32, n: Int32
# ---------- c_script_2: C# ----------
    DataTree<int> tree = new DataTree<int>();

    int count = 0;
    for(int i = 0; i < n; i++){
      for(int s = 0; s < n; s++){
        for(int t = 0; t < n; t++){
          GH_Path path = new GH_Path(i, s,t);
          tree.Add(x[count], path);

          count++;
        }
      }
    }

    A = tree;
# ---------- end c_script_2 ----------
graft_6 = GraftTree(Tree=move_5.Geometry, IncludeEmptyLists=True, IncludeNullItems=True)
Z_6 = UnitZ(Factor=range)
item_2 = ListItem(List=range, Index=1, Wrap=True)
move_6 = Move(Geometry=graft_6, Motion=Z_6)  # -> simplify(Geometry), Transform
division_2 = Division(A=item_2, B=2)
graft_7 = GraftTree(Tree=move_6.Geometry, IncludeEmptyLists=True, IncludeNullItems=True)  # -> simplify(Tree)
cull = CullPattern(List=graft_7, CullPattern=c_script_2.A)
box = CenterBox(Base=cull, X=division_2, Y=division_2, Z=division_2)

preview = CustomPreview(Geometry=box, Material=ColourSwatch(SwatchColor=RGB(102, 168, 255)))

# ==== cluster Cluster
resolution = ClusterInput()
size = ClusterInput()
geometry = ClusterInput()
int = Integer(resolution)

num = Number(size)
geo = Geometry(flatten(geometry))
range = Range(Domain=num, Steps=expr("x-1", simplify(int)))
bbox = BoundingBox(Content=geo, Plane=PlaneXY(0, 0, 0), UnionBox=True)  # -> Box, Box_2
area = Area(Geometry=bbox.Box)  # -> Area, Centroid
pt = ConstructPoint(XCoordinate=range, YCoordinate=0, ZCoordinate=0)  # -> simplify(graft(Point))
pt_2 = ConstructPoint(XCoordinate=num, YCoordinate=num, ZCoordinate=0)
pt_3 = ConstructPoint(XCoordinate=num, YCoordinate=num, ZCoordinate=num)
pt_4 = ConstructPoint(XCoordinate=0, YCoordinate=0, ZCoordinate=0)
pdecon = Deconstruct(Point=area.Centroid)  # -> XComponent, YComponent, ZComponent
division = Division(A=pt_2, B=2)
box = Box2Pt(PointA=pt_4, PointB=pt_3, Plane=PlaneXY(0, 0, 0))
Z = UnitZ(Factor=range)
pt_5 = ConstructPoint(XCoordinate=pdecon.XComponent, YCoordinate=pdecon.YComponent, ZCoordinate=0)
item = ListItem(List=range, Index=1, Wrap=True)
orient = Orient(Geometry=geo, Source=pt_5, Target=division)  # -> Geometry, Transform
division_2 = Division(A=item, B=2.01)
mesh = Mesh(orient.Geometry)
mjoin = MeshJoin(Meshes=mesh)

Y = UnitY(Factor=range)
move = Move(Geometry=pt, Motion=Y)  # -> graft(Geometry), Transform

move_2 = Move(Geometry=move.Geometry, Motion=Z)  # -> Geometry, Transform
flatten = FlattenTree(Tree=move_2.Geometry, Path="{0}")
pull = PullPoint(Point=flatten, Geometry=mjoin, ClosestOnly=True)  # -> ClosestPoint, Distance
smaller = SmallerThan(FirstNumber=pull.Distance, SecondNumber=division_2)  # -> SmallerThan, OrEqualTo
cull = CullPattern(List=flatten, CullPattern=smaller.SmallerThan)

meshcp = MeshClosestPoint(Point=flatten, Mesh=mjoin)  # -> Point, Index, Parameter
vec2pt = Vector2Pt(PointA=flatten, PointB=meshcp.Point, Unitize=False)  # -> Vector, Length
meval = MeshEval(Mesh=mjoin, Parameter=meshcp.Parameter)  # -> Point, Normal, Colour
unit = UnitVector(Vector=vec2pt.Vector)
unit_2 = UnitVector(Vector=meval.Normal)
dprod = DotProduct(VectorA=unit_2, VectorB=unit, Unitize=False)
larger = LargerThan(FirstNumber=dprod, SecondNumber=Slider(0.1, range=0..1))  # -> LargerThan, OrEqualTo

reset = ClusterInput()
file = ClusterInput()
c_script = CSharpScript(g=geo, reset=reset)  # -> out, A; inputs g: tree, reset: Boolean
# ---------- c_script: C# ----------
    count++;

    if(reset){
      count = 0;
    }

    A = count.ToString("D10");
# ---------- c_script: C# additional code ----------
  int count = 0;
# ---------- end c_script ----------
txt = Text(file)
concat = Concatenate(FragmentA=txt, FragmentC="-", FragmentB=c_script.A, FragmentD=".mat")

or = GateOr(A=smaller.SmallerThan, B=larger.OrEqualTo)

int_2 = Integer(int)
num_2 = Number(int)
path = ClusterInput()
save = ClusterInput()
int_3 = Integer(or)
gh_cpython = GH_CPython(path=path, file=concat, data=int_3, n=num_2, save=save)  # -> output; inputs path: list, file: list, data: list, n: list, save: list
#   port output: indicate your output description here. refers to a new line.
# ---------- gh_cpython: Python ----------
import numpy as np
import scipy.io

arr = np.empty((0,n,n), int)

count = 0
for i in range(n):
    arrT = np.empty((0,n), int)
    for t in range(n):
        arrS = np.empty((0), int)
        for s in range(n):
            arrS = np.append(arrS, np.array( data[count] ))
            count += 1
        arrT = np.append(arrT,np.array([arrS]), axis=0)
    arr = np.append(arr, np.array([arrT]), axis=0)

output_ = arr

if(save):
    scipy.io.savemat(path + "/" + file, {'instance':arr}, True, '5', False, True)
# ---------- end gh_cpython ----------

cull_2 = CullPattern(List=flatten, CullPattern=or)
output = ClusterOutput(cull_2)
