# Grasshopper definition russia_b.gh (Grasshopper 1.0.4)

背もたれ上端高さ = Slider(5, range=2..5, expression="x*100")
脚貫高さ = Slider(4, range=2..4, expression="x*0.2")
座面高さ = Slider(5, range=3..5, expression="x*100")
基本幅 = Slider(4, range=4..10, expression="x*100")
基本幅_2 = Slider(4, range=4..6, expression="x*100")
基本幅_3 = Slider(5, range=1..5, expression="x*0.2")
subtraction = Subtraction(A=座面高さ, B="50")
rectangle = Rectangle(Plane=PlaneXY(0, 0, 0), XSize=基本幅, YSize=基本幅_2, Radius=0)  # -> Rectangle, Length
geo = Geometry(rectangle.Rectangle)
Z = UnitZ(Factor=subtraction)
move = Move(Geometry=geo, Motion=Z)  # -> Geometry, Transform
debrep = DeconstructBrep(Brep=geo)  # -> Faces, Edges, Vertices
debrep_2 = DeconstructBrep(Brep=move.Geometry)  # -> Faces, Edges, Vertices
dom = ConstructDomain(DomainStart="-15", DomainEnd="15")
join = JoinCurves(Curves=debrep_2.Edges, Preserve=False)
rectangle_2 = Rectangle(Plane=PlaneXY(0, 0, 0), XSize=dom, YSize=dom, Radius=0)  # -> Rectangle, Length
ln = Line(StartPoint=debrep.Vertices, EndPoint=debrep_2.Vertices)
geo_2 = Geometry(rectangle_2.Rectangle)
offset = OffsetCurve(Curve=join, Distance="15", Plane=PlaneXY(0, 0, 0), Corners=1)
orient = Orient(Geometry=geo_2, Source=PlaneXY(0, 0, 0), Target=debrep.Vertices)  # -> Geometry, Transform
boundary = BoundarySurfaces(Edges=offset, UseTasks=True)
Z_2 = UnitZ(Factor="50")
graft = GraftTree(Tree=ln, IncludeEmptyLists=True, IncludeNullItems=True)
graft_2 = GraftTree(Tree=orient.Geometry, IncludeEmptyLists=True, IncludeNullItems=True)
addition = Addition(A=subtraction, B="50")
len = Length(Curve=ln)
swp1 = Sweep1(Rail=graft, Sections=graft_2, Miter=1)
Z_3 = UnitZ(Factor=addition)
multiplication = Multiplication(A=len, B=脚貫高さ)
Z_4 = UnitZ(Factor=multiplication)
move_2 = Move(Geometry=debrep.Vertices, Motion=Z_3)  # -> Geometry, Transform
move_3 = Move(Geometry=debrep.Edges, Motion=Z_4)  # -> Geometry, Transform
item = ListItem(List=move_2.Geometry, Index=0, Wrap=True)  # -> Item, Item1, Item2, Item3
item_2 = ListItem(List=move_3.Geometry, Index=0, Wrap=True)  # -> Item, Item1, Item2, Item3
Z_5 = UnitZ(Factor=1)
pt = Point([item.Item2, item.Item3])
pt_2 = Point(item.Item3)
line = Line([item_2.Item1, item_2.Item2, item_2.Item3])
join_2 = JoinCurves(Curves=line, Preserve=False)
orient_2 = Orient(Geometry=rectangle_2.Rectangle, Source=PlaneXY(0, 0, 0), Target=pt)  # -> Geometry, Transform
line_2 = LineSDL(Start=pt, Direction=Z_5, Length=背もたれ上端高さ)
end = EndPoints(Curve=join_2)  # -> Start, End
graft_3 = GraftTree(Tree=orient_2.Geometry, IncludeEmptyLists=True, IncludeNullItems=True)
graft_4 = GraftTree(Tree=line_2, IncludeEmptyLists=True, IncludeNullItems=True)
xz = XZPlane(Origin=end.Start)
swp1_2 = Sweep1(Rail=graft_4, Sections=graft_3, Miter=1)
end_2 = EndPoints(Curve=graft_4)  # -> Start, End
len_2 = Length(Curve=graft_4)
orient_3 = Orient(Geometry=rectangle_2.Rectangle, Source=PlaneXY(0, 0, 0), Target=xz)  # -> Geometry, Transform
bang = ExplodeTree(Data=end_2.End)  # -> Branch0, Branch1
cap = CapHoles(Brep=swp1_2)
pt_3 = Point(bang.Branch0)
pt_4 = Point(bang.Branch1)
ln_2 = Line(StartPoint=pt_3, EndPoint=pt_4)
len_3 = Length(Curve=ln_2)
mid = TK_MidPoint(C=ln_2)  # -> P
# ---------- mid: Python ----------
import rhinoscriptsyntax as rs

if C!=None:
    P=rs.CurveMidPoint(C)
else:
    P=None
# ---------- end mid ----------
division = Division(A=len_3, B=2)
multiplication_2 = Multiplication(A=len_2, B=基本幅_3)
xz_2 = XZPlane(Origin=mid)
subtraction_2 = Subtraction(A=division, B="15")
multiplication_3 = Multiplication(A=subtraction_2, B=-1)
dom_2 = ConstructDomain(DomainStart=multiplication_3, DomainEnd=subtraction_2)
multiplication_4 = Multiplication(A=multiplication_2, B=-1)
rectangle_3 = Rectangle(Plane=xz_2, XSize=dom_2, YSize=multiplication_4, Radius=0)  # -> Rectangle, Length
boundary_2 = BoundarySurfaces(Edges=rectangle_3.Rectangle)
Y = UnitY(Factor=dom)
extr = Extrude(Base=boundary_2, Direction=Y)
Y_2 = UnitY(Factor="-15")
swp1_3 = Sweep1(Rail=join_2, Sections=orient_3.Geometry, Miter=1)
cap_2 = CapHoles(Brep=swp1)
move_4 = Move(Geometry=extr, Motion=Y_2)  # -> Geometry, Transform
extr_2 = Extrude(Base=boundary, Direction=Z_2)
brep = Brep(cap)
brep_2 = Brep([cap_2, extr_2, brep, move_4.Geometry, swp1_3])
