# Grasshopper definition russia_c.gh (Grasshopper 1.0.4)
# plug-ins: GH_CPython

背もたれ形状_2 = Slider(1, range=1..4, expression="x*0.1")
背もたれ形状_1 = Slider(0, range=0..4, expression="x*0.1")
背もたれ支柱 = Slider(2, range=2..4)
座面高さ = Slider(3, range=3..5, expression="x*100")
基本幅 = Slider(3, range=3..8, expression="x*100")
基本奥行き = Slider(3, range=3..5, expression="x*100")
subtraction = Subtraction(A=座面高さ, B="50")
rectangle = Rectangle(Plane=PlaneXY(0, 0, 0), XSize=基本幅, YSize=基本奥行き, Radius=0)  # -> Rectangle, Length
geo = Geometry(rectangle.Rectangle)
Z = UnitZ(Factor=subtraction)
move = Move(Geometry=geo, Motion=Z)  # -> Geometry, Transform
debrep = DeconstructBrep(Brep=geo)  # -> Faces, Edges, Vertices
debrep_2 = DeconstructBrep(Brep=move.Geometry)  # -> Faces, Edges, Vertices
dom = ConstructDomain(DomainStart="-15", DomainEnd="15")
join = JoinCurves(Curves=debrep_2.Edges, Preserve=False)
rectangle_2 = Rectangle(Plane=PlaneXY(0, 0, 0), XSize=dom, YSize=dom, Radius=0)  # -> Rectangle, Length
ln = Line(StartPoint=debrep.Vertices, EndPoint=debrep_2.Vertices)
geo_2 = Geometry(rectangle_2.Rectangle)
orient = Orient(Geometry=geo_2, Source=PlaneXY(0, 0, 0), Target=debrep.Vertices)  # -> Geometry, Transform
offset = OffsetCurve(Curve=join, Distance="50", Plane=PlaneXY(0, 0, 0), Corners=1)
graft = GraftTree(Tree=ln, IncludeEmptyLists=True, IncludeNullItems=True)
graft_2 = GraftTree(Tree=orient.Geometry, IncludeEmptyLists=True, IncludeNullItems=True)
boundary = BoundarySurfaces(Edges=offset, UseTasks=True)
Z_2 = UnitZ(Factor="50")
swp1 = Sweep1(Rail=graft, Sections=graft_2, Miter=1)
extr = Extrude(Base=boundary, Direction=Z_2)
debrep_3 = DeconstructBrep(Brep=extr)  # -> Faces, Edges, Vertices
item = ListItem(List=debrep_3.Edges, Index="7", Wrap=True)
mid = TK_MidPoint(C=item)  # -> P
# ---------- mid: Python ----------
import rhinoscriptsyntax as rs

if C!=None:
    P=rs.CurveMidPoint(C)
else:
    P=None
# ---------- end mid ----------
end = EndPoints(Curve=item)  # -> Start, End
ln_2 = Line(StartPoint=end.Start, EndPoint=mid)
eval = EvaluateCurve(Curve=ln_2, Parameter=背もたれ形状_1)  # -> Point, Tangent, Angle
eval_2 = EvaluateCurve(Curve=ln_2, Parameter=背もたれ形状_2)  # -> Point, Tangent, Angle
Z_3 = UnitZ(Factor="50")
Z_4 = UnitZ(Factor="400")
move_2 = Move(Geometry=eval.Point, Motion=Z_3)  # -> Geometry, Transform
move_3 = Move(Geometry=eval_2.Point, Motion=Z_4)  # -> Geometry, Transform
yz = YZPlane(Origin=mid)
intcrv = Interpolate(Vertices=[end.Start, move_2.Geometry, move_3.Geometry], Degree=3, Periodic=False, KnotStyle=1)  # -> Curve, Length, Domain
mirror = Mirror(Geometry=intcrv.Curve, Plane=yz)  # -> Geometry, Transform
flip = FlipCurve(Curve=mirror.Geometry)  # -> Curve, Flag
blendc = BlendCurve(CurveA=intcrv.Curve, CurveB=flip.Curve, BulgeA=1, BulgeB=1, Continuity=2)
join_2 = JoinCurves(Curves=[intcrv.Curve, blendc, mirror.Geometry], Preserve=False)
Y = UnitY(Factor="-30")
cap = CapHoles(Brep=swp1)
extr_2 = Extrude(Base=join_2, Direction=Y)
offset_2 = OffsetSurface(Surface=extr_2, Distance="-30", Retrim=True)
split = SplitBrep(Brep=offset_2, Cutter=extr)
debrep_4 = DeconstructBrep(Brep=offset_2)  # -> Faces, Edges, Vertices
item_2 = ListItem(List=split, Index="0", Wrap=True)
item_3 = ListItem(List=debrep_4.Edges, Index="3", Wrap=True)
rulesrf = RuledSurface(CurveA=extr_2, CurveB=item_2)
explode = Explode(Curve=item_3, Recursive=True)  # -> Segments, Vertices
item_4 = ListItem(List=explode.Segments, Index=0, Wrap=True)  # -> Item, Item1, Item2
crv = Curve(item_4.Item)
crv_2 = Curve(item_4.Item2)
crvprox = CurveProximity(CurveA=crv, CurveB=crv_2)  # -> PointA, PointB, Distance
ln_3 = Line(StartPoint=crvprox.PointA, EndPoint=crvprox.PointB)
mid_2 = TK_MidPoint(C=ln_3)  # -> P; same code as mid
pt = Point(mid)
orient_2 = Orient(Geometry=ln_3, Source=mid_2, Target=pt)  # -> Geometry, Transform
divide = DivideCurve(Curve=orient_2.Geometry, Count=背もたれ支柱, Kinks=False)  # -> Points, Tangents, Parameters
lng = ListLength(List=divide.Points)
subtraction_2 = Subtraction(A=lng, B=2)
dom_2 = ConstructDomain(DomainStart="1", DomainEnd=subtraction_2)
subset = SubList(List=divide.Points, Domain=dom_2, Wrap=True)  # -> graft(List), Index
Z_5 = UnitZ(Factor=1)
rectangle_3 = Rectangle(Plane=PlaneXY(0, 0, 0), XSize="-10 to 10", YSize="-20", Radius=0)  # -> Rectangle, Length
line = LineSDL(Start=subset.List, Direction=Z_5, Length="10000")  # -> graft(Line)
flatten = FlattenTree(Tree=rulesrf, Path="{0}")
flatten_2 = FlattenTree(Tree=extr_2, Path="{0}")
flatten_3 = FlattenTree(Tree=item_2, Path="{0}")
clx = CurveLine(Curve=item_3, Line=line)  # -> Points, Params, Count
geo_3 = Geometry(rectangle_3.Rectangle)
ln_4 = Line(StartPoint=subset.List, EndPoint=clx.Points)
orient_3 = Orient(Geometry=geo_3, Source=PlaneXY(0, 0, 0), Target=subset.List)  # -> Geometry, Transform
swp1_2 = Sweep1(Rail=ln_4, Sections=orient_3.Geometry, Miter=1)
join_3 = BrepJoin(Breps=[flatten, flatten_2, flatten_3])  # -> Breps, Closed
brep = Brep(swp1_2)
cap_2 = CapHoles(Brep=brep)
brep_2 = Brep([cap, extr, cap_2, join_3.Breps])
brep_3 = Brep(brep_2)
panel = Panel("""基本奥行き
肘掛け高さ""")

panel_2 = Panel("""基本幅
基本奥行き
座面高さ
背もたれ形状_1
背もたれ形状_2
背もたれ支柱""")
panel_3 = Panel("動かしたいスライダー名を指定して、Saveボタンをおすと上で指定したディレクトリにmatファイルが連番で保存されます。")
c_script = CSharpScript(sliderNames=panel_2, save=Button())  # -> out; inputs sliderNames: list of String, save: Boolean
# ---------- c_script: C# ----------
    _sliderNames = sliderNames;



    if (!save)
      return;

    if (_running)
      return;


    _run = true;


    GrasshopperDocument.SolutionEnd += OnSolutionEnd;
# ---------- c_script: C# additional code ----------
  private bool _run = false;
  private bool _running = false;
  private List<string> _sliderNames;

  private void OnSolutionEnd(object sender, GH_SolutionEventArgs e)
  {
    // Unregister the event, we don't want to get called again.
    e.Document.SolutionEnd -= OnSolutionEnd;

    // If we're not supposed to run, abort now.
    if (!_run)
      return;

    // If we're already running, abort now.
    if (_running)
      return;
    
    // Reset run and running states.
    _run = false;
    _running = true;

    try
    {
      // Find all sliders.
      List<Grasshopper.Kernel.Special.GH_NumberSlider> sliders = new List<Grasshopper.Kernel.Special.GH_NumberSlider>();

      foreach (IGH_DocumentObject docObject in GrasshopperDocument.Objects)
      {
        Grasshopper.Kernel.Special.GH_NumberSlider slider = docObject as Grasshopper.Kernel.Special.GH_NumberSlider;
        if (slider == null)
          continue;
        sliders.Add(slider);
      }
      if (sliders.Count == 0)
      {
        System.Windows.Forms.MessageBox.Show("No sliders could be found", "<harsh buzzing sound>", MessageBoxButtons.OK);
        return;
      }


      List<bool> contains = new List<bool>();
      List<Grasshopper.Kernel.Special.GH_NumberSlider> filteredSliders = new List<Grasshopper.Kernel.Special.GH_NumberSlider>();
      foreach(Grasshopper.Kernel.Special.GH_NumberSlider slider in sliders){
        if(_sliderNames.Contains(slider.NickName)){
          filteredSliders.Add(slider);
        }

      }
      //A = filteredSliders.Count;

      // Set all sliders back to zero.
      //GH_Document.EnableSolutions = false;
      foreach (Grasshopper.Kernel.Special.GH_NumberSlider slider in filteredSliders)
        slider.TickValue = 0;

      while (true)
      {
        int idx = 0;
        if (!MoveToNextPermutation(ref idx, filteredSliders))
          break;

        // We've just got a new valid permutation. Solve the new solution.
        e.Document.NewSolution(false);
        Rhino.RhinoDoc.ActiveDoc.Views.Redraw();

      }

    }
    catch(Exception ex)
    {
      // Ehm, exception, best swallow it here lest it totally crashes everything.
    }
    finally
    {
      // Always make sure that _running is switched off.
      _running = false;
    }


    
  }

  private bool MoveToNextPermutation(ref int index, List<Grasshopper.Kernel.Special.GH_NumberSlider> filteredSliders)
  {
    if (index >= filteredSliders.Count)
      return false;

    Grasshopper.Kernel.Special.GH_NumberSlider slider = filteredSliders[index];
    if (slider.TickValue < slider.TickCount)
    {
      // Increment the slider.
      slider.TickValue++;
      return true;
    }
    else
    {
      // The current slider is already at the maximum value. Reset it back to zero.
      slider.TickValue = 0;

      // Move on to the next slider.
      index++;

      // If we've run out of sliders to modify, we're done permutatin'
      if (index >= filteredSliders.Count)
        return false;

      return MoveToNextPermutation(ref index, filteredSliders);
    }
  }
# ---------- end c_script ----------

panel_4 = Panel("C:/Users/RFA4/Desktop/G_Chair_mat/train_sample/russia_c")

# ----
# Path: Matファイルを保存するディレクトリ
# Size:バウンディングボックスの横・縦・高さの大きさ
# Resolution：分割数（ShapeNetsの分割数が30なので、30がいいと思います）
# Save: TrueでMatが保存されます。
# File: ファイルの名前です
# Reset: 連番のリセット
# "F:/odrive/Google Drive/JH/Projects/[096] Deep Learning Chair/02. projects/saved_data"
geo_4 = Geometry(flatten(brep_3))
number_slider = Slider(1200, range=0..1500)
number_slider_2 = Slider(30, range=0..100)
cluster = Cluster(
    geometry=geo_4,
    path=panel_4,
    size=number_slider,
    resolution=number_slider_2,
    save=Toggle(False),
    file="chair_russia_c",
    reset=Button())

int = Integer(Slider(16, range=0..100))

range = Range(Domain=number_slider, Steps=expr("x-1", simplify(number_slider_2)))
pt_2 = ConstructPoint(XCoordinate=range, YCoordinate=0, ZCoordinate=0)
gh_cpython = GH_CPython(path=panel_4, file="chair_russia_c", num=int, load=Button())  # -> output, a; inputs path: list, file: list, num: list, load: list
#   port path: [required] - [type = int] - [default = None] Descripe your input here * bullet point. * bullet point
#   port output: indicate your output description here. refers to a new line.
# ---------- gh_cpython: Python ----------
import scipy.io
import Grasshopper as gh

numformat =  str('{:010d}'.format(num))
mat = scipy.io.loadmat(path + "/" + file + "-" + numformat)

#output_ = numformat



output_ = mat["instance"].tolist()

a = mat["instance"]
# ---------- end gh_cpython ----------
graft_3 = GraftTree(Tree=pt_2, IncludeEmptyLists=True, IncludeNullItems=True)
Y_2 = UnitY(Factor=range)
panel_5 = Panel("保存したMatを確認するためのデフィニションです。")
move_4 = Move(Geometry=graft_3, Motion=Y_2)  # -> Geometry, Transform
c_script_2 = CSharpScript(x=gh_cpython.output, n=number_slider_2)  # -> out, A; inputs x: list of Int32, n: Int32
# ---------- c_script_2: C# ----------
    DataTree<int> tree = new DataTree<int>();

    int count = 0;
    for(int i = 0; i < n; i++){
      for(int s = 0; s < n; s++){
        for(int t = 0; t < n; t++){
          GH_Path path = new GH_Path(i, s,t);
          tree.Add(x[count], path);

          count++;
        }
      }
    }

    A = tree;
# ---------- end c_script_2 ----------
graft_4 = GraftTree(Tree=move_4.Geometry, IncludeEmptyLists=True, IncludeNullItems=True)
Z_6 = UnitZ(Factor=range)
item_5 = ListItem(List=range, Index=1, Wrap=True)
move_5 = Move(Geometry=graft_4, Motion=Z_6)  # -> simplify(Geometry), Transform
division = Division(A=item_5, B=2)
graft_5 = GraftTree(Tree=move_5.Geometry, IncludeEmptyLists=True, IncludeNullItems=True)  # -> simplify(Tree)
cull = CullPattern(List=graft_5, CullPattern=c_script_2.A)
box = CenterBox(Base=cull, X=division, Y=division, Z=division)

preview = CustomPreview(Geometry=box, Material=ColourSwatch(SwatchColor=RGB(102, 168, 255)))

# ==== cluster Cluster
resolution = ClusterInput()
size = ClusterInput()
geometry = ClusterInput()
int = Integer(resolution)

num = Number(size)
geo = Geometry(flatten(geometry))
range = Range(Domain=num, Steps=expr("x-1", simplify(int)))
bbox = BoundingBox(Content=geo, Plane=PlaneXY(0, 0, 0), UnionBox=True)  # -> Box, Box_2
area = Area(Geometry=bbox.Box)  # -> Area, Centroid
pt = ConstructPoint(XCoordinate=range, YCoordinate=0, ZCoordinate=0)  # -> simplify(graft(Point))
pt_2 = ConstructPoint(XCoordinate=num, YCoordinate=num, ZCoordinate=0)
pt_3 = ConstructPoint(XCoordinate=num, YCoordinate=num, ZCoordinate=num)
pt_4 = ConstructPoint(XCoordinate=0, YCoordinate=0, ZCoordinate=0)
pdecon = Deconstruct(Point=area.Centroid)  # -> XComponent, YComponent, ZComponent
division = Division(A=pt_2, B=2)
box = Box2Pt(PointA=pt_4, PointB=pt_3, Plane=PlaneXY(0, 0, 0))
Z = UnitZ(Factor=range)
pt_5 = ConstructPoint(XCoordinate=pdecon.XComponent, YCoordinate=pdecon.YComponent, ZCoordinate=0)
item = ListItem(List=range, Index=1, Wrap=True)
orient = Orient(Geometry=geo, Source=pt_5, Target=division)  # -> Geometry, Transform
division_2 = Division(A=item, B=2.01)
mesh = Mesh(orient.Geometry)
mjoin = MeshJoin(Meshes=mesh)

Y = UnitY(Factor=range)
move = Move(Geometry=pt, Motion=Y)  # -> graft(Geometry), Transform

move_2 = Move(Geometry=move.Geometry, Motion=Z)  # -> Geometry, Transform
flatten = FlattenTree(Tree=move_2.Geometry, Path="{0}")
pull = PullPoint(Point=flatten, Geometry=mjoin, ClosestOnly=True)  # -> ClosestPoint, Distance
smaller = SmallerThan(FirstNumber=pull.Distance, SecondNumber=division_2)  # -> SmallerThan, OrEqualTo
cull = CullPattern(List=flatten, CullPattern=smaller.SmallerThan)

meshcp = MeshClosestPoint(Point=flatten, Mesh=mjoin)  # -> Point, Index, Parameter
vec2pt = Vector2Pt(PointA=flatten, PointB=meshcp.Point, Unitize=False)  # -> Vector, Length
meval = MeshEval(Mesh=mjoin, Parameter=meshcp.Parameter)  # -> Point, Normal, Colour
unit = UnitVector(Vector=vec2pt.Vector)
unit_2 = UnitVector(Vector=meval.Normal)
dprod = DotProduct(VectorA=unit_2, VectorB=unit, Unitize=False)
larger = LargerThan(FirstNumber=dprod, SecondNumber=Slider(0.1, range=0..1))  # -> LargerThan, OrEqualTo

reset = ClusterInput()
file = ClusterInput()
c_script = CSharpScript(g=geo, reset=reset)  # -> out, A; inputs g: tree, reset: Boolean
# ---------- c_script: C# ----------
    count++;

    if(reset){
      count = 0;
    }

    A = count.ToString("D10");
# ---------- c_script: C# additional code ----------
  int count = 0;
# ---------- end c_script ----------
txt = Text(file)
concat = Concatenate(FragmentA=txt, FragmentC="-", FragmentB=c_script.A, FragmentD=".mat")

or = GateOr(A=smaller.SmallerThan, B=larger.OrEqualTo)

int_2 = Integer(int)
num_2 = Number(int)
path = ClusterInput()
save = ClusterInput()
int_3 = Integer(or)
gh_cpython = GH_CPython(path=path, file=concat, data=int_3, n=num_2, save=save)  # -> output; inputs path: list, file: list, data: list, n: list, save: list
#   port output: indicate your output description here. refers to a new line.
# ---------- gh_cpython: Python ----------
import numpy as np
import scipy.io

arr = np.empty((0,n,n), int)

count = 0
for i in range(n):
    arrT = np.empty((0,n), int)
    for t in range(n):
        arrS = np.empty((0), int)
        for s in range(n):
            arrS = np.append(arrS, np.array( data[count] ))
            count += 1
        arrT = np.append(arrT,np.array([arrS]), axis=0)
    arr = np.append(arr, np.array([arrT]), axis=0)

output_ = arr

if(save):
    scipy.io.savemat(path + "/" + file, {'instance':arr}, True, '5', False, True)
# ---------- end gh_cpython ----------

cull_2 = CullPattern(List=flatten, CullPattern=or)
output = ClusterOutput(cull_2)
